# Grasshopper definition GH collada exporter 13.gh (Grasshopper 0.8.51)

# COLLADA EXPORTER THATCHED TOGETHER FROM A GENERIC (GROUPED) BOX EXPORTED AS .DAE FROM SKETCHUP 7 USING PLAYUP.
brep = Brep(<brep referenced from the Rhino model>)
mesh = MeshBrep(
    Brep=brep,
    Settings={Refine=True, JaggedSeams=False, SimplePlanes=True, GridMinCount=16, GridMaxCount=0, Tolerance=0, RefineAngle=0, MinTolerance=0, RelativeTolerance=0.65, MinEdgeLength=0.0001, MaxEdgeLength=0})
generate_object_indexes = Panel(" ")
lng = ListLength(List=mesh)
series = Series(Start=0, Step=1, Count=lng)  # -> graft(Series)
simplify = SimplifyTree(Tree=series, Front=False)
get_face_vertex_indexes = VBScript()  # -> out, A, B, C, S
# ---------- get_face_vertex_indexes: VB ----------
    'Dim F As Rhino.Geometry.MeshFace
    A = F.A
    B = F.B
    C = F.C
    S = vbCRLF + "                        " + F.A.ToString + " " + F.B.ToString + " " + F.C.ToString
# ---------- end get_face_vertex_indexes ----------
object_index = Integer(simplify)
tri = Triangulate(Mesh=flatten(mesh))  # -> Mesh, Count
object_index_2 = Integer(simplify)
join = StringJoin(Strings=get_face_vertex_indexes.S, Join=" ")
decompose_mesh = VBScript(M=tri.Mesh)  # -> out, V, F, N; inputs M: Mesh
# ---------- decompose_mesh: C# ----------
    V = M.Vertices
    F = M.Faces
    N = M.Normals
# ---------- end decompose_mesh ----------
create_instance_geometry_xml = VBScript(N=object_index)  # -> out, A
# ---------- create_instance_geometry_xml: C# ----------
    A = "                    <instance_geometry url=""#geometries_" + N.ToString + """>" + vbCRLF
    A = A + "                        <bind_material>" + vbCRLF
    A = A + "                            <technique_common>" + vbCRLF
    A = A + "                                <instance_material symbol=""test__1__playupnomaterial__physDefault"" target=""#test__1__playupnomaterial__physDefault"">" + vbCRLF
    A = A + "                                    <bind semantic=""diffuse_TEXCOORD"" target=""geometries_" + N.ToString + "-""></bind>" + vbCRLF
    A = A + "                                </instance_material>" + vbCRLF
    A = A + "                            </technique_common>" + vbCRLF
    A = A + "                        </bind_material>" + vbCRLF
    A = A + "                    </instance_geometry>"
# ---------- end create_instance_geometry_xml ----------
lng_numfaces = ListLength(List=decompose_mesh.F)
lng_2 = ListLength(List=decompose_mesh.N)
# <triangles><p> contains lines, each one representing a vertex
# 
# the format is this:
# 
# [vertex index] [normal] [texcoord]
# 
# texcoord seems like it can be made identical to vertex index with no invalid texture mapping... ?
series_2 = Series(Start=0, Step=1, Count=lng_2)
point_to_string = VBScript(P=decompose_mesh.V)  # -> out, S; inputs P: Point3d
# ---------- point_to_string: C# ----------
    S = vbCRLF + "                        " + P.X.ToString + " " + P.Y.ToString + " " + P.Z.ToString
# ---------- end point_to_string ----------
lng_3 = ListLength(List=decompose_mesh.V)
simplify_2 = SimplifyTree(Tree=series_2, Front=False)
point_to_string_2 = VBScript(P=decompose_mesh.N)  # -> out, S; inputs P: Point3d; same code as point_to_string
multiplication = Multiplication(A=lng_3, B=3)
join_2 = StringJoin(Strings=point_to_string.S, Join=" ")
join_3 = StringJoin(Strings=point_to_string_2.S, Join=" ")
create_tris_triplet = VBScript(Tri=decompose_mesh.F, NormalIndex=simplify_2)  # -> out, A
# ---------- create_tris_triplet: C# ----------
    A = "                        " + Tri.A.ToString + " " + NormalIndex.ToString + " " + Tri.A.ToString + vbCRLF
    A = A + "                        " + Tri.B.ToString + " " + NormalIndex.ToString + " " + Tri.B.ToString + vbCRLF
    A = A + "                        " + Tri.C.ToString + " " + NormalIndex.ToString + " " + Tri.C.ToString + vbCRLF
# ---------- end create_tris_triplet ----------
join_4 = StringJoin(Strings=create_tris_triplet.A)
create_geometry_xml = VBScript(N=object_index_2, VCC=multiplication, VC=lng_3, TC=lng_numfaces, VS=join_2, NS=join_3, TS=join_4)  # -> out, A
# ---------- create_geometry_xml: VB ----------
    A = "        <geometry id=""geometries_" + N.ToString + """>" + vbCRLF
    A = A + "            <mesh>" + vbCRLF

    'VERTEX POSITIONS
    A = A + "                <source id=""geometries_" + N.ToString + "-Pos"">" + vbCRLF
    A = A + "                    <float_array id=""VERTCOMPS" + N.ToString + """ count=""" + VCC.ToString + """>" + VS + vbCRLF
    A = A + "                    </float_array>" + vbCRLF
    A = A + "                    <technique_common>" + vbCRLF
    A = A + "                        <accessor count=""24"" source=""#geometries_" + N.ToString + "-Pos-array"" count=""" + VC.ToString + """ stride=""3"">" + vbCRLF
    A = A + "                            <param name=""X"" type=""float"" />" + vbCRLF
    A = A + "                            <param name=""Y"" type=""float"" />" + vbCRLF
    A = A + "                            <param name=""Z"" type=""float"" />" + vbCRLF
    A = A + "                        </accessor>" + vbCRLF
    A = A + "                    </technique_common>" + vbCRLF
    A = A + "                </source>" + vbCRLF

    'NORMALS
    A = A + "                <source id=""geometries_" + N.ToString + "-Normal"">" + vbCRLF
    A = A + "                    <float_array id=""geometries_" + N.ToString + "-Normal-array"" count=""" + VCC.ToString + """>" + NS + vbCRLF
    A = A + "                    </float_array>" + vbCRLF
    A = A + "                    <technique_common>" + vbCRLF
    A = A + "                        <accessor count=""24"" source=""geometries_" + N.ToString + "-Normal-array"" count=""" + VC.ToString + """ stride=""3"">" + vbCRLF
    A = A + "                            <param name=""X"" type=""float"" />" + vbCRLF
    A = A + "                            <param name=""Y"" type=""float"" />" + vbCRLF
    A = A + "                            <param name=""Z"" type=""float"" />" + vbCRLF
    A = A + "                        </accessor>" + vbCRLF
    A = A + "                    </technique_common>" + vbCRLF
    A = A + "                </source>" + vbCRLF

    'TEXTURE PROJECTION
    A = A + "                <source id=""geometries_" + N.ToString + "-Texture_Projection"">" + vbCRLF
    A = A + "                    <float_array id=""geometries_" + N.ToString + "-Texture_Projection-array"" count=""" + VCC.ToString + """>" + vbCRLF
    A = A + "                        TEXCOORD VALUES HERE" + vbCRLF
    A = A + "                    </float_array>" + vbCRLF
    A = A + "                    <technique_common>" + vbCRLF
    A = A + "                        <accessor source=""#geometries_" + N.ToString + "-Texture_Projection-array"" count=""" + VC.ToString + """ stride=""2"">" + vbCRLF
    A = A + "                            <param name=""S"" type=""float""/>" + vbCRLF
    A = A + "                            <param name=""T"" type=""float""/>" + vbCRLF
    A = A + "                        </accessor>" + vbCRLF
    A = A + "                    </technique_common>" + vbCRLF
    A = A + "                </source>" + vbCRLF

    'VERTICES
    A = A + "                <vertices id=""geometries_" + N.ToString + "-Vtx"">" + vbCRLF
    A = A + "                    <input semantic=""POSITION"" source=""#geometries_" + N.ToString + "-Pos""/>" + vbCRLF
    A = A + "                </vertices>" + vbCRLF

    'TRIS
    A = A + "                <triangles count=""" + TC.ToString + """ material=""test__1__playupnomaterial__physDefault"">" + vbCRLF
    A = A + "                    <input semantic=""VERTEX"" source=""#geometries_" + N.ToString + "-Vtx"" offset=""0"" />" + vbCRLF
    A = A + "                    <input semantic=""NORMAL"" source=""#geometries_" + N.ToString + "-Normal"" offset=""1"" />" + vbCRLF
    A = A + "                    <input semantic=""TEXCOORD"" source=""#geometries_" + N.ToString + "-Texture_Projection"" offset=""2"" />" + vbCRLF
    A = A + "                    <p>" + vbCRLF
    A = A + TS
    A = A + "                    </p>" + vbCRLF
    A = A + "                </triangles>" + vbCRLF

    A = A + "            </mesh>" + vbCRLF
    A = A + "        </geometry>"
# ---------- end create_geometry_xml ----------
instance_geometry_element = String(create_instance_geometry_xml.A)
geometry_element = String(create_geometry_xml.A)
instance_geometry_element_2 = String(create_instance_geometry_xml.A)
geometry_element_2 = String(create_geometry_xml.A)
str = String(instance_geometry_element_2)
str_2 = String(geometry_element_2)
panel = Panel("""<?xml version="1.0" encoding="UTF-8" standalone="no" ?>
<COLLADA xmlns="http://www.collada.org/2005/11/COLLADASchema" version="1.4.1">
    <asset>
        <contributor>
            <authoring_tool>Google SketchUp 7.1.6087</authoring_tool>
        </contributor>
        <created>2011-09-01T15:24:19Z</created>
        <modified>2011-09-01T15:24:19Z</modified>
        <unit meter="1" name="meter" />
        <up_axis>Z_UP</up_axis>
    </asset>
    <library_visual_scenes>
        <visual_scene id="ONEVISUALSCENE">
            <node name="SketchUp">
                <node id="ONEGROUP" name="group_0">
                    <matrix>1 0 0 0 0 1 0 0 0 0 1 0 0 0 0 1</matrix>""")
instance_geometry_element_3 = Panel(str)
panel_2 = Panel("""                </node>
            </node>
        </visual_scene>
    </library_visual_scenes>
    <library_geometries>""")
geometry_element_3 = Panel(str_2)
panel_3 = Panel("""    </library_geometries>
    <library_materials>
        <material id="ONEMATERIAL" name="material_0">
            <instance_effect url="#ONEEFFECT" />
        </material>
    </library_materials>
    <library_effects>
        <effect id="ONEEFFECT">
            <profile_COMMON>
                <technique sid="COMMON">
                    <lambert>
                        <diffuse>
                            <color>0.8901961 0.8823529 0.8705882 1</color>
                        </diffuse>
                    </lambert>
                </technique>
            </profile_COMMON>
        </effect>
    </library_effects>
    <scene>
        <instance_visual_scene url="#ONEVISUALSCENE" />
    </scene>
</COLLADA>""")
geometry_element_4 = Panel(geometry_element)
panel_4 = Panel("""                </node>
            </node>
        </visual_scene>
    </library_visual_scenes>
    <scene>
        <instance_visual_scene url="#visual_scenes_0"/>
    </scene>
</COLLADA>""")
# </library_geometries>
#     <library_visual_scenes>
#         <visual_scene id="visual_scenes_0" name="untitled">
#             <node id="CryExportNode_test">
#                     <translate sid="translation">0.000000 0.000000 0.000000</translate>
#                     <rotate sid="rotateZ">0.000000 0.000000 1.000000 0.000000</rotate>
#                     <rotate sid="rotateY">0.000000 1.000000 0.000000 0.000000</rotate>
#                     <rotate sid="rotateX">1.000000 0.000000 0.000000 0.000000</rotate>
#                     <scale sid="scale">1.000000 1.000000 1.000000</scale>
#                             <node id="mesh0%root%0%">
instance_geometry = Panel(instance_geometry_element)
newline = Panel("")
join_5 = StringJoin(Strings=flatten(geometry_element_2), Join=newline)
join_6 = StringJoin(Strings=flatten(instance_geometry_element_2), Join=newline)
concatenate_all_xml_parts = VBScript(S1=panel, S2=join_6, S3=panel_2, S4=join_5, S5=panel_3)  # -> out, A
# ---------- concatenate_all_xml_parts: C# ----------
    A = S1 + VbCrLf + S2 + VbCrLf + S3 + VbCrLf + S4 + VbCrLf + S5
# ---------- end concatenate_all_xml_parts ----------
get_current_gh_file_path = VBScript()  # -> out, Path
# ---------- get_current_gh_file_path: VB ----------
    'A = Grasshopper.GH_InstanceServer.DocumentServer.Contains(

    Dim k As GH_Document = Grasshopper.GH_InstanceServer.DocumentServer(0)
    Path = k.FilePath.Substring(0, k.FilePath.LastIndexOf("\"))
# ---------- end get_current_gh_file_path ----------
dae_xml_data = String(concatenate_all_xml_parts.A)
# Save DAE File: This should save a DAE named the same as the text in the "Filename" panel. It saves to the same directory this Grasshopper script is located.
filename = Panel("test11")
write_dae = CSharpScript(Filename=filename, Filepath=get_current_gh_file_path.Path, XML=dae_xml_data)  # -> out, A; inputs Filename: String, Filepath: String, XML: String
# ---------- write_dae: C# ----------
    string filepath = @Filepath + @"\" + @Filename + @".dae";
    //filepath.Replace(@" ", @"\u0020");
    System.IO.File.WriteAllText(filepath, XML);
    A = filepath;
# ---------- end write_dae ----------
