# Grasshopper definition GH collada exporter 14.gh (Grasshopper 0.8.51)

brep = Brep([<brep referenced from the Rhino model> x2])
# COLLADA EXPORTER THATCHED TOGETHER FROM A GENERIC (GROUPED) BOX EXPORTED AS .DAE FROM SKETCHUP 7 USING PLAYUP.
generate_object_indexes = Panel(" ")
lng = ListLength()
series_from_list = VBScript(L=brep)  # -> out, graft(N); inputs L: list
# ---------- series_from_list: VB ----------
    Dim listOfInts As List (Of Integer) = New List(Of Integer)
    listOfInts.Clear()
    For i As Integer = 0 To L.Count - 1
      listOfInts.Add(i)
    Next
    N = listOfInts
# ---------- end series_from_list ----------
ensure_mesh_is_only_tris = Panel(" ")
mesh = MeshBrep(
    Brep=brep,
    Settings={Refine=True, JaggedSeams=False, SimplePlanes=True, GridMinCount=16, GridMaxCount=0, Tolerance=0, RefineAngle=0, MinTolerance=0, RelativeTolerance=0.65, MinEdgeLength=0.0001, MaxEdgeLength=0})
series = Series(Start=0, Step=1, Count=lng)  # -> graft(Series)
tri = Triangulate(Mesh=flatten(mesh))  # -> Mesh, Count
simplify = SimplifyTree(Tree=series, Front=False)
decompose_mesh = VBScript(M=tri.Mesh)  # -> out, V, F, N; inputs M: Mesh
# ---------- decompose_mesh: C# ----------
    V = M.Vertices
    F = M.Faces
    N = M.Normals
# ---------- end decompose_mesh ----------
# A Basic Step Towards Texture Mapping?: The idea here would be similar to SketchUp's default map placement method (google it, PlayUp site describes it clearly; im just not familiar enough with the 3D geometric terminology to explain it as clearly here)
vertices = Point(decompose_mesh.V)
decompose_face = VBScript(F=decompose_mesh.F)  # -> out, A, B, C
# ---------- decompose_face: C# ----------
    A = F.A
    B = F.B
    C = F.C
# ---------- end decompose_face ----------
item = ListItem(List=vertices, Index=decompose_face.A, Wrap=False)
item_2 = ListItem(List=vertices, Index=decompose_face.B, Wrap=False)
item_3 = ListItem(List=vertices, Index=decompose_face.C, Wrap=False)
object_index = Integer(simplify)
tri_2 = Triangulate()  # -> Mesh, Count
object_index_2 = Integer(simplify)
brep_tree = Brep(brep)
object_index_3 = Integer(series_from_list.N)
placeholder_texture_projection_coords = Panel("""0 0
                    0 20
                    20 0""")
decompose_mesh_2 = VBScript(M=tri_2.Mesh)  # -> out, V, F, N; inputs M: Mesh; same code as decompose_mesh
ln = Line(PointA=item, PointB=item_2)
ln_2 = Line(PointA=item_2, PointB=item_3)
ln_3 = Line(PointA=item_3, PointB=item)
create_instance_geometry_xml = VBScript(N=object_index)  # -> out, A
# ---------- create_instance_geometry_xml: C# ----------
    A = "                    <instance_geometry url=""#geometries_" + N.ToString + """>" + vbCRLF
    A = A + "                        <bind_material>" + vbCRLF
    A = A + "                            <technique_common>" + vbCRLF
    A = A + "                                <instance_material symbol=""test__1__playupnomaterial__physDefault"" target=""#test__1__playupnomaterial__physDefault"">" + vbCRLF
    A = A + "                                    <bind semantic=""diffuse_TEXCOORD"" target=""geometries_" + N.ToString + "-""></bind>" + vbCRLF
    A = A + "                                </instance_material>" + vbCRLF
    A = A + "                            </technique_common>" + vbCRLF
    A = A + "                        </bind_material>" + vbCRLF
    A = A + "                    </instance_geometry>"
# ---------- end create_instance_geometry_xml ----------
lng_numfaces = ListLength(List=decompose_mesh_2.F)
lng_2 = ListLength(List=decompose_mesh_2.N)
set_item_for_each_item_in_tree = VBScript(L=brep_tree, I=placeholder_texture_projection_coords)  # -> out, graft(A)
# ---------- set_item_for_each_item_in_tree: C# ----------
    A = I
# ---------- end set_item_for_each_item_in_tree ----------
# <triangles><p> contains lines, each one representing a vertex
# 
# the format is this:
# 
# [vertex index] [normal] [texcoord]
# 
# texcoord seems like it can be made identical to vertex index with no invalid texture mapping... ?
series_2 = Series(Start=0, Step=1, Count=lng_2)
point_to_string = VBScript(P=decompose_mesh_2.V)  # -> out, S; inputs P: Point3d
# ---------- point_to_string: C# ----------
    S = vbCRLF + "                        " + P.X.ToString + " " + P.Y.ToString + " " + P.Z.ToString
# ---------- end point_to_string ----------
lng_3 = ListLength(List=decompose_mesh_2.V)
create_geometries_n_pos_element = CSharpScript(P=decompose_mesh.V, N=series_from_list.N)  # -> out, A; inputs P: list of Point3d, N: Int32
# ---------- create_geometries_n_pos_element: C# ----------
    //define indents for ease of change later
    const string tab = "    ";
    const string indentString1 = tab + tab + tab + tab;
    const string indentString2 = indentString1 + tab;
    const string indentString3 = indentString2 + tab;
    const string indentString4 = indentString3 + tab;
    const string kind = @"Pos";
    const int stride = 3;

    //create string of positions
    A = @"";
    for(int i = 0; i < P.Count; i++){
      A = A + indentString3 + P[i].X + " " + P[i].Y + " " + P[i].Y + "\n";
    }

    //create the XML string
    A = indentString1 + "<source id=\"geometries_" + N.ToString() + "-" + kind + "\">\n" +
      indentString2 + "<float_array id=\"geometries_" + N.ToString() + "-" + kind + "-array\" count=\"" + P.Count + "\">\n" +
      A +
      indentString2 + "</float_array>\n" +
      indentString2 + "<technique_common>\n" +
      indentString3 + "<accessor source=\"#geometries_" + N.ToString() + "-" + kind + "-array\" count=\"" + (P.Count / stride).ToString() + "\" stride=\"" + stride + "\">\n" +
      indentString4 + "<param name=\"X\" type=\"float\"/>\n" +
      indentString4 + "<param name=\"Y\" type=\"float\"/>\n" +
      indentString4 + "<param name=\"Z\" type=\"float\"/>\n" +
      indentString3 + "</accessor>\n" +
      indentString2 + "</technique_common>\n" +
      indentString1 + "</source>\n";
# ---------- end create_geometries_n_pos_element ----------
create_geometries_n_normal_element = CSharpScript(P=decompose_mesh.N, N=series_from_list.N)  # -> out, A; inputs P: list of Point3d, N: Int32
# ---------- create_geometries_n_normal_element: C# ----------
    //define indents for ease of change later
    const string tab = "    ";
    const string indentString1 = tab + tab + tab + tab;
    const string indentString2 = indentString1 + tab;
    const string indentString3 = indentString2 + tab;
    const string indentString4 = indentString3 + tab;
    const string kind = @"Normal";
    const int stride = 3;

    //create string of positions
    A = @"";
    for(int i = 0; i < P.Count; i++){
      A = A + indentString3 + P[i].X + " " + P[i].Y + " " + P[i].Y + "\n";
    }

    //create the XML string
    A = indentString1 + "<source id=\"geometries_" + N.ToString() + "-" + kind + "\">\n" +
      indentString2 + "<float_array id=\"geometries_" + N.ToString() + "-" + kind + "-array\" count=\"" + P.Count + "\">\n" +
      A +
      indentString2 + "</float_array>\n" +
      indentString2 + "<technique_common>\n" +
      indentString3 + "<accessor source=\"#geometries_" + N.ToString() + "-" + kind + "-array\" count=\"" + (P.Count / stride).ToString() + "\" stride=\"" + stride + "\">\n" +
      indentString4 + "<param name=\"X\" type=\"float\"/>\n" +
      indentString4 + "<param name=\"Y\" type=\"float\"/>\n" +
      indentString4 + "<param name=\"Z\" type=\"float\"/>\n" +
      indentString3 + "</accessor>\n" +
      indentString2 + "</technique_common>\n" +
      indentString1 + "</source>\n";
# ---------- end create_geometries_n_normal_element ----------
create_geometries_n_texture_projection_e = CSharpScript(P=set_item_for_each_item_in_tree.A, N=object_index_3)  # -> out, A; "Create Geometries_N-Texture_Projection element"; inputs P: list of String, N: Int32
# ---------- create_geometries_n_texture_projection_e: C# ----------
    //define indents for ease of change later
    const string tab = "    ";
    const string indentString1 = tab + tab + tab + tab;
    const string indentString2 = indentString1 + tab;
    const string indentString3 = indentString2 + tab;
    const string indentString4 = indentString3 + tab;
    const string kind = @"Texture_Projection";
    const int stride = 2;

    //create string of positions
    A = @"";
    for(int i = 0; i < P.Count; i++){
      A = A + indentString3 + P[i] + "\n";//P[i].X + " " + P[i].Y + " " + P[i].Y + "\n";
    }

    //create the XML string
    A = indentString1 + "<source id=\"geometries_" + N.ToString() + "-" + kind + "\">\n" +
      indentString2 + "<float_array id=\"geometries_" + N.ToString() + "-" + kind + "-array\" count=\"6\">\n" +
      // note the above line's count= used to be: P.Count
      A +
      indentString2 + "</float_array>\n" +
      indentString2 + "<technique_common>\n" +
      indentString3 + "<accessor source=\"#geometries_" + N.ToString() + "-" + kind + "-array\" count=\"3\" stride=\"" + stride + "\">\n" +
      // note the above line's count= used to be: (P.Count / stride).ToString()
      indentString4 + "<param name=\"S\" type=\"float\"/>\n" +
      indentString4 + "<param name=\"T\" type=\"float\"/>\n" +
      indentString3 + "</accessor>\n" +
      indentString2 + "</technique_common>\n" +
      indentString1 + "</source>\n";
# ---------- end create_geometries_n_texture_projection_e ----------
create_geometries_n_triangles_element = VBScript(T=decompose_mesh.F, N=series_from_list.N)  # -> out, A; inputs T: list
# ---------- create_geometries_n_triangles_element: VB ----------
    A = "                <vertices id=""geometries_" + N.ToString + "-Vtx"">" + vbCRLF
    A = A + "                    <input semantic=""POSITION"" source=""#geometries_" + N.ToString + "-Pos""/>" + vbCRLF
    A = A + "                </vertices>" + vbCRLF
    A = A + "                <triangles count=""12"" material=""PlayUpGrp0__1__playupnomaterial__physDefault"">" + vbCRLF
    A = A + "                    <input semantic=""VERTEX"" source=""#geometries_" + N.ToString + "-Vtx"" offset=""0""/>" + vbCRLF
    A = A + "                    <input semantic=""NORMAL"" source=""#geometries_" + N.ToString + "-Normal"" offset=""1""/>" + vbCRLF
    A = A + "                    <input semantic=""TEXCOORD"" source=""#geometries_" + N.ToString + "-Texture_Projection"" offset=""2""/>" + vbCRLF
    A = A + "                    <p>" + vbCRLF
    For Each tri As Rhino.Geometry.MeshFace In T
      A = A + "                        " + tri.A.ToString + " " + tri.B.ToString + " " + tri.C.ToString + vbCRLF
    Next
    A = A + "                    </p>" + vbCRLF
    A = A + "                </triangles>" + vbCRLF
# ---------- end create_geometries_n_triangles_element ----------
simplify_2 = SimplifyTree(Tree=series_2, Front=False)
point_to_string_2 = VBScript(P=decompose_mesh_2.N)  # -> out, S; inputs P: Point3d; same code as point_to_string
multiplication = Multiplication(A=lng_3, B=3)
join = StringJoin(Strings=point_to_string.S, Join=" ")
join_2 = StringJoin(Strings=point_to_string_2.S, Join=" ")
create_tris_triplet = VBScript(Tri=decompose_mesh_2.F, NormalIndex=simplify_2)  # -> out, A
# ---------- create_tris_triplet: C# ----------
    A = "                        " + Tri.A.ToString + " " + NormalIndex.ToString + " " + Tri.A.ToString + vbCRLF
    A = A + "                        " + Tri.B.ToString + " " + NormalIndex.ToString + " " + Tri.B.ToString + vbCRLF
    A = A + "                        " + Tri.C.ToString + " " + NormalIndex.ToString + " " + Tri.C.ToString + vbCRLF
# ---------- end create_tris_triplet ----------
join_3 = StringJoin(Strings=create_tris_triplet.A)
create_geometry_xml = VBScript(N=object_index_2, VCC=multiplication, VC=lng_3, TC=lng_numfaces, VS=join, NS=join_2, TS=join_3)  # -> out, A
# ---------- create_geometry_xml: VB ----------
    A = "        <geometry id=""geometries_" + N.ToString + """>" + vbCRLF
    A = A + "            <mesh>" + vbCRLF

    'VERTEX POSITIONS
    A = A + "                <source id=""geometries_" + N.ToString + "-Pos"">" + vbCRLF
    A = A + "                    <float_array id=""VERTCOMPS" + N.ToString + """ count=""" + VCC.ToString + """>" + VS + vbCRLF
    A = A + "                    </float_array>" + vbCRLF
    A = A + "                    <technique_common>" + vbCRLF
    A = A + "                        <accessor count=""24"" source=""#geometries_" + N.ToString + "-Pos-array"" count=""" + VC.ToString + """ stride=""3"">" + vbCRLF
    A = A + "                            <param name=""X"" type=""float"" />" + vbCRLF
    A = A + "                            <param name=""Y"" type=""float"" />" + vbCRLF
    A = A + "                            <param name=""Z"" type=""float"" />" + vbCRLF
    A = A + "                        </accessor>" + vbCRLF
    A = A + "                    </technique_common>" + vbCRLF
    A = A + "                </source>" + vbCRLF

    'NORMALS
    A = A + "                <source id=""geometries_" + N.ToString + "-Normal"">" + vbCRLF
    A = A + "                    <float_array id=""geometries_" + N.ToString + "-Normal-array"" count=""" + VCC.ToString + """>" + NS + vbCRLF
    A = A + "                    </float_array>" + vbCRLF
    A = A + "                    <technique_common>" + vbCRLF
    A = A + "                        <accessor count=""24"" source=""geometries_" + N.ToString + "-Normal-array"" count=""" + VC.ToString + """ stride=""3"">" + vbCRLF
    A = A + "                            <param name=""X"" type=""float"" />" + vbCRLF
    A = A + "                            <param name=""Y"" type=""float"" />" + vbCRLF
    A = A + "                            <param name=""Z"" type=""float"" />" + vbCRLF
    A = A + "                        </accessor>" + vbCRLF
    A = A + "                    </technique_common>" + vbCRLF
    A = A + "                </source>" + vbCRLF

    'TEXTURE PROJECTION
    A = A + "                <source id=""geometries_" + N.ToString + "-Texture_Projection"">" + vbCRLF
    A = A + "                    <float_array id=""geometries_" + N.ToString + "-Texture_Projection-array"" count=""" + VCC.ToString + """>" + vbCRLF
    A = A + "                        TEXCOORD VALUES HERE" + vbCRLF
    A = A + "                    </float_array>" + vbCRLF
    A = A + "                    <technique_common>" + vbCRLF
    A = A + "                        <accessor source=""#geometries_" + N.ToString + "-Texture_Projection-array"" count=""" + VC.ToString + """ stride=""2"">" + vbCRLF
    A = A + "                            <param name=""S"" type=""float""/>" + vbCRLF
    A = A + "                            <param name=""T"" type=""float""/>" + vbCRLF
    A = A + "                        </accessor>" + vbCRLF
    A = A + "                    </technique_common>" + vbCRLF
    A = A + "                </source>" + vbCRLF

    'VERTICES
    A = A + "                <vertices id=""geometries_" + N.ToString + "-Vtx"">" + vbCRLF
    A = A + "                    <input semantic=""POSITION"" source=""#geometries_" + N.ToString + "-Pos""/>" + vbCRLF
    A = A + "                </vertices>" + vbCRLF

    'TRIS
    A = A + "                <triangles count=""" + TC.ToString + """ material=""test__1__playupnomaterial__physDefault"">" + vbCRLF
    A = A + "                    <input semantic=""VERTEX"" source=""#geometries_" + N.ToString + "-Vtx"" offset=""0"" />" + vbCRLF
    A = A + "                    <input semantic=""NORMAL"" source=""#geometries_" + N.ToString + "-Normal"" offset=""1"" />" + vbCRLF
    A = A + "                    <input semantic=""TEXCOORD"" source=""#geometries_" + N.ToString + "-Texture_Projection"" offset=""2"" />" + vbCRLF
    A = A + "                    <p>" + vbCRLF
    A = A + TS
    A = A + "                    </p>" + vbCRLF
    A = A + "                </triangles>" + vbCRLF

    A = A + "            </mesh>" + vbCRLF
    A = A + "        </geometry>"
# ---------- end create_geometry_xml ----------
part_1 = Panel("""<?xml version="1.0" encoding="utf-8"?>
<COLLADA xmlns="http://www.collada.org/2005/11/COLLADASchema" version="1.4.1">
    <asset>
        <contributor>
            <authoring_tool>PlayUp</authoring_tool>                            
        </contributor>
        <created>2011-09-06T18:06:31Z</created>                                         
        <modified>2011-09-06T18:06:31Z</modified>                                        
        <revision>1.4.1</revision>
        <unit meter="1.0" name="meter"></unit>
        <up_axis>Z_UP</up_axis>
    </asset>
    <library_images>
        <image id="playupnomaterial_tif_img" format="bitmap" height="32" width="32" depth="32">
            <init_from>file:///C:/Users/nesis/Desktop/work stuff/russel 25-08 holidays/GH collada exporter/PlayupExports2/textures/playup_nomaterial.tif</init_from>
        </image>
    </library_images>
    <library_effects>
        <effect id="PlayUpGrp0-1-playupnomaterial_fx">                                
            <profile_COMMON>
                <newparam sid="playupnomaterial_tif_surface">
                    <surface type="2D">
                        <init_from>playupnomaterial_tif_img</init_from>
                    </surface>
                </newparam>
                <newparam sid="playupnomaterial_tif_sampler">
                    <sampler2D>
                        <source>playupnomaterial_tif_surface</source>
                    </sampler2D>
                </newparam>
                <technique sid="default">
                    <phong>
                        <emission>
                            <color sid="emission">0.000000 0.000000 0.000000 1.000000</color>
                        </emission>
                        <ambient>
                            <color sid="ambient">0.000000 0.000000 0.000000 1.000000</color>
                        </ambient>
                        <diffuse>
                            <color sid="diffuse">0.84 0.84 0.84 1.000000</color>
                        </diffuse>
                        <specular>
                            <color sid="specular">0.000000 0.000000 0.000000 1.000000</color>
                        </specular>
                        <shininess>
                            <float sid="shininess">0.000000</float>
                        </shininess>
                        <reflective>
                            <color sid="reflective">0.000000 0.000000 0.000000 1.000000</color>
                        </reflective>
                        <reflectivity>
                            <float sid="reflectivity">0.000000</float>
                        </reflectivity>
                        <transparent opaque="RGB_ZERO">
                            <color sid="transparent">0.000000 0.000000 0.000000 0.000000</color>
                        </transparent>
                        <transparency>
                            <float sid="transparency">0.000000</float>
                        </transparency>
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""")
create_geometries_n_element = CSharpScript(
    Pos=create_geometries_n_pos_element.A,
    Norm=create_geometries_n_normal_element.A,
    Tex=create_geometries_n_texture_projection_e.A,
    Tri=create_geometries_n_triangles_element.A,
    N=series_from_list.N)  # -> out, flatten(A); inputs Pos: String, Norm: String, Tex: String, Tri: String, N: Int32
# ---------- create_geometries_n_element: C# ----------
    A = "        <geometry id=\"geometries_" + N.ToString() + "\">\n" +
      "            <mesh>\n" +
      Pos +
      Norm +
      Tex +
      Tri +
      "            </mesh>\n" +
      "        </geometry>\n";
# ---------- end create_geometries_n_element ----------
part_2 = Panel("""    </library_geometries>
    <library_visual_scenes>
        <visual_scene id="visual_scenes_0" name="untitled">
            <node id="CryExportNode_PlayUpGrp0">                                                                        
                    <translate sid="translation">0.000000 0.000000 0.000000</translate>
                    <rotate sid="rotateZ">0.000000 0.000000 1.000000 0.000000</rotate>
                    <rotate sid="rotateY">0.000000 1.000000 0.000000 0.000000</rotate>
                    <rotate sid="rotateX">1.000000 0.000000 0.000000 0.000000</rotate>
                    <scale sid="scale">1.000000 1.000000 1.000000</scale>
                            <node id="mesh0%root%0%">""")
create_instance_geometry_element = CSharpScript(N=series_from_list.N)  # -> out, flatten(A); inputs N: Int32
# ---------- create_instance_geometry_element: C# ----------
    A = "                                <instance_geometry url=\"#geometries_" + N.ToString() + "\">\n" +
      "                                    <bind_material>\n" +
      "                                        <technique_common>\n" +
      "                                            <instance_material symbol=\"PlayUpGrp0__1__playupnomaterial__physDefault\" target=\"#PlayUpGrp0__1__playupnomaterial__physDefault\">\n" +
      "                                                <bind semantic=\"diffuse_TEXCOORD\" target=\"geometries_" + N.ToString() + "-\"></bind>\n" +
      "                                            </instance_material>\n" +
      "                                        </technique_common>\n" +
      "                                    </bind_material>\n" +
      "                                </instance_geometry>\n";
# ---------- end create_instance_geometry_element ----------
part_3 = Panel("""                </node>
            </node>
        </visual_scene>
    </library_visual_scenes>
    <scene>
        <instance_visual_scene url="#visual_scenes_0"/>
    </scene>
</COLLADA>""")
join_4 = StringJoin(Strings=create_instance_geometry_element.A)
join_5 = StringJoin(Strings=create_geometries_n_element.A)
instance_geometry_element = String(create_instance_geometry_xml.A)
geometry_element = String(create_geometry_xml.A)
instance_geometry_element_2 = String(create_instance_geometry_xml.A)
geometry_element_2 = String(create_geometry_xml.A)
str = String(instance_geometry_element_2)
str_2 = String(geometry_element_2)
panel = Panel("""<?xml version="1.0" encoding="UTF-8" standalone="no" ?>
<COLLADA xmlns="http://www.collada.org/2005/11/COLLADASchema" version="1.4.1">
    <asset>
        <contributor>
            <authoring_tool>Google SketchUp 7.1.6087</authoring_tool>
        </contributor>
        <created>2011-09-01T15:24:19Z</created>
        <modified>2011-09-01T15:24:19Z</modified>
        <unit meter="1" name="meter" />
        <up_axis>Z_UP</up_axis>
    </asset>
    <library_visual_scenes>
        <visual_scene id="ONEVISUALSCENE">
            <node name="SketchUp">
                <node id="ONEGROUP" name="group_0">
                    <matrix>1 0 0 0 0 1 0 0 0 0 1 0 0 0 0 1</matrix>""")
instance_geometry_element_3 = Panel(str)
panel_2 = Panel("""                </node>
            </node>
        </visual_scene>
    </library_visual_scenes>
    <library_geometries>""")
geometry_element_3 = Panel(str_2)
panel_3 = Panel("""    </library_geometries>
    <library_materials>
        <material id="ONEMATERIAL" name="material_0">
            <instance_effect url="#ONEEFFECT" />
        </material>
    </library_materials>
    <library_effects>
        <effect id="ONEEFFECT">
            <profile_COMMON>
                <technique sid="COMMON">
                    <lambert>
                        <diffuse>
                            <color>0.8901961 0.8823529 0.8705882 1</color>
                        </diffuse>
                    </lambert>
                </technique>
            </profile_COMMON>
        </effect>
    </library_effects>
    <scene>
        <instance_visual_scene url="#ONEVISUALSCENE" />
    </scene>
</COLLADA>""")
geometry_element_4 = Panel(geometry_element)
panel_4 = Panel("""                </node>
            </node>
        </visual_scene>
    </library_visual_scenes>
    <scene>
        <instance_visual_scene url="#visual_scenes_0"/>
    </scene>
</COLLADA>""")
# </library_geometries>
#     <library_visual_scenes>
#         <visual_scene id="visual_scenes_0" name="untitled">
#             <node id="CryExportNode_test">
#                     <translate sid="translation">0.000000 0.000000 0.000000</translate>
#                     <rotate sid="rotateZ">0.000000 0.000000 1.000000 0.000000</rotate>
#                     <rotate sid="rotateY">0.000000 1.000000 0.000000 0.000000</rotate>
#                     <rotate sid="rotateX">1.000000 0.000000 0.000000 0.000000</rotate>
#                     <scale sid="scale">1.000000 1.000000 1.000000</scale>
#                             <node id="mesh0%root%0%">
instance_geometry = Panel(instance_geometry_element)
newline = Panel("")
newline_2 = Panel("")
join_6 = StringJoin(Strings=[part_1, join_5, part_2, join_4, part_3], Join=newline)
join_7 = StringJoin(Strings=flatten(geometry_element_2), Join=newline_2)
join_8 = StringJoin(Strings=flatten(instance_geometry_element_2), Join=newline_2)
concatenate_all_xml_parts = VBScript(S1=panel, S2=join_8, S3=panel_2, S4=join_7, S5=panel_3)  # -> out, A
# ---------- concatenate_all_xml_parts: C# ----------
    A = S1 + VbCrLf + S2 + VbCrLf + S3 + VbCrLf + S4 + VbCrLf + S5
# ---------- end concatenate_all_xml_parts ----------
get_current_gh_file_path = VBScript()  # -> out, Path
# ---------- get_current_gh_file_path: VB ----------
    'A = Grasshopper.GH_InstanceServer.DocumentServer.Contains(

    Dim k As GH_Document = Grasshopper.GH_InstanceServer.DocumentServer(0)
    Path = k.FilePath.Substring(0, k.FilePath.LastIndexOf("\"))
# ---------- end get_current_gh_file_path ----------
# Save DAE File: This should save a DAE named the same as the text in the "Filename" panel. It saves to the same directory this Grasshopper script is located.
filename = Panel("test12")
dae_xml_string_data = String(join_6)
write_dae = CSharpScript(Filename=filename, Filepath=get_current_gh_file_path.Path, XML=dae_xml_string_data)  # -> out, A; inputs Filename: String, Filepath: String, XML: String
# ---------- write_dae: C# ----------
    string filepath = @Filepath + @"\" + @Filename + @".dae";
    //filepath.Replace(@" ", @"\u0020");
    System.IO.File.WriteAllText(filepath, XML);
    A = filepath;
# ---------- end write_dae ----------
where_file_was_written_to = Panel(write_dae.A)
