# Grasshopper definition GH collada exporter 17.gh (Grasshopper 0.8.51)

# COLLADA EXPORTER THATCHED TOGETHER FROM A GENERIC (GROUPED) BOX AND SOME OTHER BASIC TRIANGULATED SHAPES EXPORTED AS .DAE FROM SKETCHUP 7 USING PLAYUP.
# INPUT: NOTES:
# The file is saved in this Grasshopper file's folder.
# You don't need to add .dae to the Filename, the script will do that for you.
# All you need to do is write in a filename, and link the Breps you want to export to the "Breps to Export" node.
filename = Panel("test12")
breps_to_export = Brep(<brep referenced from the Rhino model>)
series_from_list = VBScript(L=breps_to_export)  # -> out, graft(N); inputs L: list
# ---------- series_from_list: VB ----------
    Dim listOfInts As List (Of Integer) = New List(Of Integer)
    listOfInts.Clear()
    For i As Integer = 0 To L.Count - 1
      listOfInts.Add(i)
    Next
    N = listOfInts
# ---------- end series_from_list ----------
ensure_mesh_is_only_tris = Panel(" ")
mesh = MeshBrep(
    Brep=breps_to_export,
    Settings={Refine=True, JaggedSeams=False, SimplePlanes=True, GridMinCount=16, GridMaxCount=0, Tolerance=0, RefineAngle=0, MinTolerance=0, RelativeTolerance=0.65, MinEdgeLength=0.0001, MaxEdgeLength=0})
tri = Triangulate(Mesh=flatten(mesh))  # -> Mesh, Count
face_index = Slider(0, range=0..23)
tri_index = Slider(0, range=0..2)
decompose_mesh = VBScript(M=tri.Mesh)  # -> out, V, F, N; inputs M: Mesh
# ---------- decompose_mesh: C# ----------
    V = M.Vertices
    F = M.Faces
    N = M.Normals
# ---------- end decompose_mesh ----------
# <triangles><p> contains lines, each one representing a vertex
# 
# the format is this:
# 
# [vertex index] [normal] [texcoord]
# 
# texcoord seems like it can be made identical to vertex index with no invalid texture mapping... ?
decompose_face = VBScript(F=decompose_mesh.F)  # -> out, A, B, C, T
# ---------- decompose_face: C# ----------
    A = F.A
    B = F.B
    C = F.C
    T = New List(Of Object)
    T.Add(F.A)
    T.Add(F.B)
    T.Add(F.C)
# ---------- end decompose_face ----------
# A Basic Step Towards Texture Mapping?: The idea here would be similar to SketchUp's default map placement method (google it, PlayUp site describes it clearly; im just not familiar enough with the 3D geometric terminology to explain it as clearly here)
normals = Point(decompose_mesh.N)
vertices = Point(decompose_mesh.V)
item = ListItem(List=vertices, Index=decompose_face.A, Wrap=False)
item_2 = ListItem(List=vertices, Index=decompose_face.B, Wrap=False)
item_3 = ListItem(List=vertices, Index=decompose_face.C, Wrap=False)
brep_tree = Brep(breps_to_export)
object_index = Integer(series_from_list.N)
placeholder_texture_projection_coords = Panel("""0 0
                        0 20
                        20 0""")
ln = Line(PointA=item, PointB=item_2)
ln_2 = Line(PointA=item_2, PointB=item_3)
ln_3 = Line(PointA=item_3, PointB=item)
item_4 = ListItem(List=normals, Index=face_index, Wrap=False)
pl_3pt = Plane3Pt(PointA=item, PointB=item_2, PointC=item_3)
pl_3pt_2 = Plane3Pt(PointA=item_3, PointB=item, PointC=item_2)
pl_3pt_3 = Plane3Pt(PointA=item_2, PointB=item_3, PointC=item)
set_item_for_each_item_in_tree = VBScript(L=brep_tree, I=placeholder_texture_projection_coords)  # -> out, graft(A)
# ---------- set_item_for_each_item_in_tree: C# ----------
    A = I
# ---------- end set_item_for_each_item_in_tree ----------
subtraction = Subtraction(A=Point(0, 0, 0), B=item_4)
origin = Point(Point(5.420477818, 5.678268431, 0), Expression="{0,0,0}")
item_5 = ListItem(List=pl_3pt, Index=expr("Floor(i/2)", face_index), Wrap=False)
item_6 = ListItem(List=pl_3pt_2, Index=expr("Floor(i/2)", face_index), Wrap=False)
item_7 = ListItem(List=pl_3pt_3, Index=expr("Floor(i/2)", face_index), Wrap=False)
create_geometries_n_triangles_element = VBScript(T=decompose_mesh.F, N=series_from_list.N)  # -> out, A; inputs T: list
# ---------- create_geometries_n_triangles_element: VB ----------
    A = "                <vertices id=""geometries_" + N.ToString + "-Vtx"">" + vbCRLF
    A = A + "                    <input semantic=""POSITION"" source=""#geometries_" + N.ToString + "-Pos""/>" + vbCRLF
    A = A + "                </vertices>" + vbCRLF
    A = A + "                <triangles count=""" + T.Count.ToString + """ material=""PlayUpGrp0__1__playupnomaterial__physDefault"">" + vbCRLF
    A = A + "                    <input semantic=""VERTEX"" source=""#geometries_" + N.ToString + "-Vtx"" offset=""0""/>" + vbCRLF
    A = A + "                    <input semantic=""NORMAL"" source=""#geometries_" + N.ToString + "-Normal"" offset=""1""/>" + vbCRLF
    A = A + "                    <input semantic=""TEXCOORD"" source=""#geometries_" + N.ToString + "-Texture_Projection"" offset=""2""/>" + vbCRLF
    A = A + "                    <p>" + vbCRLF
    Dim triCounter As Integer = 0
    For Each tri As Rhino.Geometry.MeshFace In T
      'A = A + "                        " + tri.A.ToString + " " + tri.B.ToString + " " + tri.C.ToString + vbCRLF
      A = A + CreateTriString(tri.A, triCounter, 0)
      A = A + CreateTriString(tri.B, triCounter, 1)
      A = A + CreateTriString(tri.C, triCounter, 2)
      triCounter = triCounter + 1
    Next
    A = A + "                    </p>" + vbCRLF
    A = A + "                </triangles>" + vbCRLF
# ---------- create_geometries_n_triangles_element: VB additional code ----------
  Private Function CreateTriString (ByVal T As Integer, ByVal N As Integer, ByVal TexCoordIndex As Integer) As String
    Return "                        " + T.ToString + vbTAB + N.ToString + vbTAB + TexCoordIndex.ToString + vbCRLF
  End Function
# ---------- end create_geometries_n_triangles_element ----------
create_geometries_n_pos_element = CSharpScript(P=decompose_mesh.V, N=series_from_list.N)  # -> out, A; inputs P: list of Point3d, N: Int32
# ---------- create_geometries_n_pos_element: C# ----------
    //define indents for ease of change later
    const string tab = "    ";
    const string indentString1 = tab + tab + tab + tab;
    const string indentString2 = indentString1 + tab;
    const string indentString3 = indentString2 + tab;
    const string indentString4 = indentString3 + tab;
    const string kind = @"Pos";
    const int stride = 3;

    //create string of positions
    A = @"";
    for(int i = 0; i < P.Count; i++){
      A = A + indentString3 + P[i].X + " " + P[i].Y + " " + P[i].Y + "\n";
    }

    //create the XML string
    A = indentString1 + "<source id=\"geometries_" + N.ToString() + "-" + kind + "\">\n" +
      indentString2 + "<float_array id=\"geometries_" + N.ToString() + "-" + kind + "-array\" count=\"" + (P.Count*stride).ToString() + "\">\n" +
      A +
      indentString2 + "</float_array>\n" +
      indentString2 + "<technique_common>\n" +
      indentString3 + "<accessor source=\"#geometries_" + N.ToString() + "-" + kind + "-array\" count=\"" + P.Count.ToString() + "\" stride=\"" + stride + "\">\n" +
      indentString4 + "<param name=\"X\" type=\"float\"/>\n" +
      indentString4 + "<param name=\"Y\" type=\"float\"/>\n" +
      indentString4 + "<param name=\"Z\" type=\"float\"/>\n" +
      indentString3 + "</accessor>\n" +
      indentString2 + "</technique_common>\n" +
      indentString1 + "</source>\n";
# ---------- end create_geometries_n_pos_element ----------
create_geometries_n_normal_element = CSharpScript(P=decompose_mesh.N, N=series_from_list.N)  # -> out, A; inputs P: list of Point3d, N: Int32
# ---------- create_geometries_n_normal_element: C# ----------
    //define indents for ease of change later
    const string tab = "    ";
    const string indentString1 = tab + tab + tab + tab;
    const string indentString2 = indentString1 + tab;
    const string indentString3 = indentString2 + tab;
    const string indentString4 = indentString3 + tab;
    const string kind = @"Normal";
    const int stride = 3;

    //create string of positions
    A = @"";
    for(int i = 0; i < P.Count; i++){
      A = A + indentString3 + P[i].X + " " + P[i].Y + " " + P[i].Y + "\n";
    }

    //create the XML string
    A = indentString1 + "<source id=\"geometries_" + N.ToString() + "-" + kind + "\">\n" +
      indentString2 + "<float_array id=\"geometries_" + N.ToString() + "-" + kind + "-array\" count=\"" + (P.Count*stride).ToString() + "\">\n" +
      A +
      indentString2 + "</float_array>\n" +
      indentString2 + "<technique_common>\n" +
      indentString3 + "<accessor source=\"#geometries_" + N.ToString() + "-" + kind + "-array\" count=\"" + P.Count.ToString() + "\" stride=\"" + stride + "\">\n" +
      indentString4 + "<param name=\"X\" type=\"float\"/>\n" +
      indentString4 + "<param name=\"Y\" type=\"float\"/>\n" +
      indentString4 + "<param name=\"Z\" type=\"float\"/>\n" +
      indentString3 + "</accessor>\n" +
      indentString2 + "</technique_common>\n" +
      indentString1 + "</source>\n";
# ---------- end create_geometries_n_normal_element ----------
create_geometries_n_texture_projection_e = CSharpScript(P=set_item_for_each_item_in_tree.A, N=object_index)  # -> out, A; "Create Geometries_N-Texture_Projection element"; inputs P: list of String, N: Int32
# ---------- create_geometries_n_texture_projection_e: C# ----------
    //define indents for ease of change later
    const string tab = "    ";
    const string indentString1 = tab + tab + tab + tab;
    const string indentString2 = indentString1 + tab;
    const string indentString3 = indentString2 + tab;
    const string indentString4 = indentString3 + tab;
    const string kind = @"Texture_Projection";
    const int stride = 2;

    //create string of positions
    A = @"";
    for(int i = 0; i < P.Count; i++){
      A = A + indentString3 + P[i] + "\n";//P[i].X + " " + P[i].Y + " " + P[i].Y + "\n";
    }

    //create the XML string
    A = indentString1 + "<source id=\"geometries_" + N.ToString() + "-" + kind + "\">\n" +
      indentString2 + "<float_array id=\"geometries_" + N.ToString() + "-" + kind + "-array\" count=\"6\">\n" +
      // note the above line's count= used to be: P.Count
      A +
      indentString2 + "</float_array>\n" +
      indentString2 + "<technique_common>\n" +
      indentString3 + "<accessor source=\"#geometries_" + N.ToString() + "-" + kind + "-array\" count=\"3\" stride=\"" + stride + "\">\n" +
      // note the above line's count= used to be: (P.Count / stride).ToString()
      indentString4 + "<param name=\"S\" type=\"float\"/>\n" +
      indentString4 + "<param name=\"T\" type=\"float\"/>\n" +
      indentString3 + "</accessor>\n" +
      indentString2 + "</technique_common>\n" +
      indentString1 + "</source>\n";
# ---------- end create_geometries_n_texture_projection_e ----------
projectin_direction_line = LineSDL(Start=origin, Direction=item_4, Length=1)
plx = LinePlane(Line=projectin_direction_line, Plane=item_5)  # -> Point, ParamL, ParamP
plx_2 = LinePlane(Line=projectin_direction_line, Plane=item_6)  # -> Point, ParamL, ParamP
plx_3 = LinePlane(Line=projectin_direction_line, Plane=item_7)  # -> Point, ParamL, ParamP
pcomp = Decompose(Point=plx.ParamP)  # -> XComponent, YComponent, ZComponent
pcomp_2 = Decompose(Point=plx_2.ParamP)  # -> XComponent, YComponent, ZComponent
pcomp_3 = Decompose(Point=plx_3.ParamP)  # -> XComponent, YComponent, ZComponent
space = Panel(" ")
join = StringJoin(Strings=[pcomp.XComponent, pcomp.YComponent], Join=space)
join_2 = StringJoin(Strings=[pcomp_2.XComponent, pcomp_2.YComponent], Join=space)
join_3 = StringJoin(Strings=[pcomp_3.XComponent, pcomp_3.YComponent], Join=space)
newline = Panel("")
create_geometries_n_element = CSharpScript(
    Pos=create_geometries_n_pos_element.A,
    Norm=create_geometries_n_normal_element.A,
    Tex=create_geometries_n_texture_projection_e.A,
    Tri=create_geometries_n_triangles_element.A,
    N=series_from_list.N)  # -> out, flatten(A); inputs Pos: String, Norm: String, Tex: String, Tri: String, N: Int32
# ---------- create_geometries_n_element: C# ----------
    A = "        <geometry id=\"geometries_" + N.ToString() + "\">\n" +
      "            <mesh>\n" +
      Pos +
      Norm +
      Tex +
      Tri +
      "            </mesh>\n" +
      "        </geometry>\n";
# ---------- end create_geometries_n_element ----------
create_instance_geometry_element = CSharpScript(N=series_from_list.N)  # -> out, flatten(A); inputs N: Int32
# ---------- create_instance_geometry_element: C# ----------
    A = "                                <instance_geometry url=\"#geometries_" + N.ToString() + "\">\n" +
      "                                    <bind_material>\n" +
      "                                        <technique_common>\n" +
      "                                            <instance_material symbol=\"PlayUpGrp0__1__playupnomaterial__physDefault\" target=\"#PlayUpGrp0__1__playupnomaterial__physDefault\">\n" +
      "                                                <bind semantic=\"diffuse_TEXCOORD\" target=\"geometries_" + N.ToString() + "-\"></bind>\n" +
      "                                            </instance_material>\n" +
      "                                        </technique_common>\n" +
      "                                    </bind_material>\n" +
      "                                </instance_geometry>\n";
# ---------- end create_instance_geometry_element ----------
part_1 = Panel("""<?xml version="1.0" encoding="utf-8"?>
<COLLADA xmlns="http://www.collada.org/2005/11/COLLADASchema" version="1.4.1">
    <asset>
        <contributor>
            <authoring_tool>PlayUp</authoring_tool>                            
        </contributor>
        <created>2011-09-06T18:06:31Z</created>                                         
        <modified>2011-09-06T18:06:31Z</modified>                                        
        <revision>1.4.1</revision>
        <unit meter="1.0" name="meter"></unit>
        <up_axis>Z_UP</up_axis>
    </asset>
    <library_images>
        <image id="playupnomaterial_tif_img" format="bitmap" height="32" width="32" depth="32">
            <init_from>file:///C:/Users/nesis/Desktop/work stuff/russel 25-08 holidays/GH collada exporter/PlayupExports2/textures/playup_nomaterial.tif</init_from>
        </image>
    </library_images>
    <library_effects>
        <effect id="PlayUpGrp0-1-playupnomaterial_fx">                                
            <profile_COMMON>
                <newparam sid="playupnomaterial_tif_surface">
                    <surface type="2D">
                        <init_from>playupnomaterial_tif_img</init_from>
                    </surface>
                </newparam>
                <newparam sid="playupnomaterial_tif_sampler">
                    <sampler2D>
                        <source>playupnomaterial_tif_surface</source>
                    </sampler2D>
                </newparam>
                <technique sid="default">
                    <phong>
                        <emission>
                            <color sid="emission">0.000000 0.000000 0.000000 1.000000</color>
                        </emission>
                        <ambient>
                            <color sid="ambient">0.000000 0.000000 0.000000 1.000000</color>
                        </ambient>
                        <diffuse>
                            <color sid="diffuse">0.84 0.84 0.84 1.000000</color>
                        </diffuse>
                        <specular>
                            <color sid="specular">0.000000 0.000000 0.000000 1.000000</color>
                        </specular>
                        <shininess>
                            <float sid="shininess">0.000000</float>
                        </shininess>
                        <reflective>
                            <color sid="reflective">0.000000 0.000000 0.000000 1.000000</color>
                        </reflective>
                        <reflectivity>
                            <float sid="reflectivity">0.000000</float>
                        </reflectivity>
                        <transparent opaque="RGB_ZERO">
                            <color sid="transparent">0.000000 0.000000 0.000000 0.000000</color>
                        </transparent>
                        <transparency>
                            <float sid="transparency">0.000000</float>
                        </transparency>
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""")
part_2 = Panel("""    </library_geometries>
    <library_visual_scenes>
        <visual_scene id="visual_scenes_0" name="untitled">
            <node id="CryExportNode_PlayUpGrp0">                                                                        
                    <translate sid="translation">0.000000 0.000000 0.000000</translate>
                    <rotate sid="rotateZ">0.000000 0.000000 1.000000 0.000000</rotate>
                    <rotate sid="rotateY">0.000000 1.000000 0.000000 0.000000</rotate>
                    <rotate sid="rotateX">1.000000 0.000000 0.000000 0.000000</rotate>
                    <scale sid="scale">1.000000 1.000000 1.000000</scale>
                            <node id="mesh0%root%0%">""")
part_3 = Panel("""                </node>
            </node>
        </visual_scene>
    </library_visual_scenes>
    <scene>
        <instance_visual_scene url="#visual_scenes_0"/>
    </scene>
</COLLADA>""")
join_4 = StringJoin(Strings=[join, join_2, join_3], Join=newline)
join_5 = StringJoin(Strings=create_instance_geometry_element.A)
join_6 = StringJoin(Strings=create_geometries_n_element.A)
st_coordinates = Panel(join_4)
newline_2 = Panel("")
join_7 = StringJoin(Strings=[part_1, join_6, part_2, join_5, part_3], Join=newline_2)
get_current_gh_file_path = VBScript()  # -> out, Path
# ---------- get_current_gh_file_path: VB ----------
    'A = Grasshopper.GH_InstanceServer.DocumentServer.Contains(

    Dim k As GH_Document = Grasshopper.GH_InstanceServer.DocumentServer(0)
    Path = k.FilePath.Substring(0, k.FilePath.LastIndexOf("\"))
# ---------- end get_current_gh_file_path ----------
# Save DAE File: This should save a DAE named the same as the text in the "Filename" panel. It saves to the same directory this Grasshopper script is located.
filename_2 = String(filename)
dae_xml_string_data = String(join_7)
write_dae = CSharpScript(Filename=filename_2, Filepath=get_current_gh_file_path.Path, XML=dae_xml_string_data)  # -> out, A; inputs Filename: String, Filepath: String, XML: String
# ---------- write_dae: C# ----------
    string filepath = @Filepath + @"\" + @Filename + @".dae";
    //filepath.Replace(@" ", @"\u0020");
    System.IO.File.WriteAllText(filepath, XML);
    A = filepath;
# ---------- end write_dae ----------
where_file_was_written_to = Panel(write_dae.A)
