# Grasshopper definition GH collada exporter 2.gh (Grasshopper 0.8.51)

# COLLADA EXPORTER THATCHED TOGETHER FROM A GENERIC (GROUPED) BOX EXPORTED AS .DAE FROM SKETCHUP 7.
box = Box2Pt(PointA=Point(0, 0, 0), PointB=Point(10, 10, 10), Plane=PlaneXY(0, 0, 0))
mesh = MeshBrep(
    Brep=box,
    Settings={Refine=True, JaggedSeams=False, SimplePlanes=True, GridMinCount=16, GridMaxCount=0, Tolerance=0, RefineAngle=0, MinTolerance=0, RelativeTolerance=0.65, MinEdgeLength=0.0001, MaxEdgeLength=0})
tri = Triangulate(Mesh=mesh)  # -> Mesh, Count
# INSTRUCTIONS: Right click this and change where it streams to to save a new DAE file. You'll probably want to enter your own filename (eg, myExport.dae).
decompose_mesh = VBScript(M=tri.Mesh)  # -> out, V, F, N; inputs M: Mesh
# ---------- decompose_mesh: C# ----------
    V = M.Vertices
    F = M.Faces
    N = M.Normals
# ---------- end decompose_mesh ----------
create_vertex_xml = Panel(" ")
point_to_string = VBScript(P=decompose_mesh.V)  # -> out, S; inputs P: Point3d
# ---------- point_to_string: C# ----------
    S = P.X.ToString + " " + P.Y.ToString + " " + P.Z.ToString
# ---------- end point_to_string ----------
point_to_string_2 = VBScript(P=decompose_mesh.N)  # -> out, S; inputs P: Point3d; same code as point_to_string
get_face_vertex_indexes = VBScript(F=decompose_mesh.F)  # -> out, A, B, C, S
# ---------- get_face_vertex_indexes: VB ----------
    'Dim F As Rhino.Geometry.MeshFace
    A = F.A
    B = F.B
    C = F.C
    S = F.A.ToString + " " + F.B.ToString + " " + F.C.ToString
# ---------- end get_face_vertex_indexes ----------
lng = ListLength(List=decompose_mesh.V)
lng_2 = ListLength(List=decompose_mesh.N)
multiplication = Multiplication(A=lng, B=3)
join = StringJoin(Strings=point_to_string.S, Join=" ")
multiplication_2 = Multiplication(A=lng_2, B=3)
join_2 = StringJoin(Strings=point_to_string_2.S, Join=" ")
lng_3 = ListLength(List=decompose_mesh.F)
join_3 = StringJoin(Strings=get_face_vertex_indexes.S, Join=" ")
create_vertex_xml_2 = VBScript(VCC=multiplication, VC=lng, VS=join)  # -> out, A
# ---------- create_vertex_xml_2: C# ----------
    A = "                <source id=""ID6"">" + VbCrLf
    A = A + "                  <float_array id=""ID9"" count=""" + VCC.ToString + """>" + VS + "</float_array>" + VbCrLf
    A = A + "                  <technique_common>" + VbCrLf
    A = A + "                    <accessor count=""" + VC.ToString + """ source=""#ID9"" stride=""3"">" + VbCrLf
    A = A + "                      <param name=""X"" type=""float"" />" + VbCrLf
    A = A + "                      <param name=""Y"" type=""float"" />" + VbCrLf
    A = A + "                      <param name=""Z"" type=""float"" />" + VbCrLf
    A = A + "                    </accessor>" + VbCrLf
    A = A + "                  </technique_common>" + VbCrLf
    A = A + "                </source>"
# ---------- end create_vertex_xml_2 ----------
create_normals_xml = VBScript(VCC=multiplication_2, VC=lng_2, VS=join_2)  # -> out, A
# ---------- create_normals_xml: C# ----------
    A = "                <source id=""ID7"">" + VbCrLf
    A = A + "                    <float_array id=""ID10"" count=""" + VCC.ToString + """>" + VS + "</float_array>" + VbCrLf
    A = A + "                    <technique_common>" + VbCrLf
    A = A + "                        <accessor count=""" + VC.ToString + """ source=""#ID10"" stride=""3"">" + VbCrLf
    A = A + "                            <param name=""X"" type=""float"" />" + VbCrLf
    A = A + "                            <param name=""Y"" type=""float"" />" + VbCrLf
    A = A + "                            <param name=""Z"" type=""float"" />" + VbCrLf
    A = A + "                        </accessor>" + VbCrLf
    A = A + "                    </technique_common>" + VbCrLf
    A = A + "                </source>"
# ---------- end create_normals_xml ----------
create_triangles_xml_2 = VBScript(VC=lng_3, VS=join_3)  # -> out, A
# ---------- create_triangles_xml_2: C# ----------
    A = "                <triangles count=""" + VC.ToString + """ material=""Material2"">" + VbCrLf
    A = A + "                  <input offset=""0"" semantic=""VERTEX"" source=""#ID8"" />" + VbCrLf
    A = A + "                  <p>" + VS + "</p>" + VbCrLf
    A = A + "                </triangles>"
# ---------- end create_triangles_xml_2 ----------
panel = Panel(create_vertex_xml_2.A)
panel_2 = Panel(create_normals_xml.A)
panel_3 = Panel(create_triangles_xml_2.A)
part1 = Panel("""<?xml version="1.0" encoding="UTF-8" standalone="no" ?>
<COLLADA xmlns="http://www.collada.org/2005/11/COLLADASchema" version="1.4.1">
    <asset>
        <contributor>
            <authoring_tool>Google SketchUp 7.1.6087</authoring_tool>
        </contributor>
        <created>2011-09-01T11:15:22Z</created>
        <modified>2011-09-01T11:15:22Z</modified>
        <unit meter="0.0254" name="inch" />
        <up_axis>Z_UP</up_axis>
    </asset>
    <library_visual_scenes>
        <visual_scene id="ID1">
            <node name="SketchUp">
                <node id="ID2" name="group_0">
                    <matrix>1 0 0 0 0 1 0 0 0 0 1 0 0 0 0 1</matrix>
                    <instance_geometry url="#ID3">
                        <bind_material>
                            <technique_common>
                                <instance_material symbol="Material2" target="#ID5">
                                    <bind_vertex_input semantic="UVSET0" input_semantic="TEXCOORD" input_set="0" />
                                </instance_material>
                            </technique_common>
                        </bind_material>
                    </instance_geometry>
                </node>
            </node>
        </visual_scene>
    </library_visual_scenes>
    <library_geometries>
        <geometry id="ID3">
            <mesh>""")
part2 = Panel("""                <vertices id="ID8">
                    <input semantic="POSITION" source="#ID6" />
                    <input semantic="NORMAL" source="#ID7" />
                </vertices>""")
part3 = Panel("""            </mesh>
        </geometry>
    </library_geometries>
    <library_materials>
        <material id="ID5" name="material_0">
            <instance_effect url="#ID4" />
        </material>
    </library_materials>
    <library_effects>
        <effect id="ID4">
            <profile_COMMON>
                <technique sid="COMMON">
                    <lambert>
                        <diffuse>
                            <color>0.8901961 0.8823529 0.8705882 1</color>
                        </diffuse>
                    </lambert>
                </technique>
            </profile_COMMON>
        </effect>
    </library_effects>
    <scene>
        <instance_visual_scene url="#ID1" />
    </scene>
</COLLADA>""")
concatenate_all_xml_parts = VBScript(S1=part1, S2=create_vertex_xml_2.A, S3=create_normals_xml.A, S4=part2, S5=create_triangles_xml_2.A, S6=part3)  # -> out, A
# ---------- concatenate_all_xml_parts: C# ----------
    A = S1 + VbCrLf + S2 + VbCrLf + S3 + VbCrLf + S4 + VbCrLf + S5 + VbCrLf + S6
# ---------- end concatenate_all_xml_parts ----------
output = Panel(concatenate_all_xml_parts.A)
