# Grasshopper definition GH collada exporter 20.gh (Grasshopper 0.8.51)

# DESCRIPTION: COLLADA EXPORTER THATCHED TOGETHER FROM A GENERIC (GROUPED) BOX AND SOME OTHER BASIC TRIANGULATED SHAPES EXPORTED AS .DAE FROM SKETCHUP 7 USING PLAYUP.
# INPUT: USAGE NOTES:
# The file is saved in this Grasshopper file's folder.
# You don't need to add .dae to the Filename, the script will do that for you.
# All you need to do is write in a filename, and link the Breps you want to export to the "Breps to Export" node.
filename = Panel("test14")
# Technical Notes: This is a Collada exporter thatched together based on a Collada pattern discerned by looking at various kinds of models exported by PlayUp from Sketchup 7.
# 
# The texture file provided is a default 32x32 pixel 32 bit depth .tiff. If you look in the large panel titled "Part 1", there's a definition of the texture. If you want RC.exe to work, you need to ensure that is a valid filepath.
breps_to_export = Brep(<brep referenced from the Rhino model>)
ensure_mesh_is_only_tris = Panel(" ")
mesh = MeshBrep(
    Brep=breps_to_export,
    Settings={Refine=True, JaggedSeams=False, SimplePlanes=True, GridMinCount=16, GridMaxCount=0, Tolerance=0, RefineAngle=0, MinTolerance=0, RelativeTolerance=0.65, MinEdgeLength=0.0001, MaxEdgeLength=0})
tri = Triangulate(Mesh=flatten(mesh))  # -> Mesh, Count
series_from_list = VBScript(L=breps_to_export)  # -> out, graft(N); inputs L: list
# ---------- series_from_list: VB ----------
    Dim listOfInts As List (Of Integer) = New List(Of Integer)
    listOfInts.Clear()
    For i As Integer = 0 To L.Count - 1
      listOfInts.Add(i)
    Next
    N = listOfInts
# ---------- end series_from_list ----------
vbscript_decompose_mesh = VBScript(M=tri.Mesh)  # -> out, V, F, TC; inputs M: Mesh
# ---------- vbscript_decompose_mesh: C# ----------
    V = M.Vertices
    F = M.Faces
    TC = M.TextureCoordinates
# ---------- end vbscript_decompose_mesh ----------
facen = FaceNormals(Mesh=tri.Mesh)  # -> Centers, Normals
# Convert Texture Coord to DAE-friendly String: NOTE:
# Coordinate is normalized. For it to work properly, you need to get the image dimensions, and multiply the components by them.
pcomp = Decompose(Point=vbscript_decompose_mesh.TC)  # -> graft(XComponent), graft(YComponent), ZComponent
space = Panel(" ")
join = StringJoin(Strings=[pcomp.XComponent, pcomp.YComponent], Join=space)  # -> flatten(Result)
create_geometries_n_triangles_element = VBScript(T=vbscript_decompose_mesh.F, N=series_from_list.N)  # -> out, A; inputs T: list
# ---------- create_geometries_n_triangles_element: VB ----------
    A = "                <vertices id=""geometries_" + N.ToString + "-Vtx"">" + vbCRLF
    A = A + "                    <input semantic=""POSITION"" source=""#geometries_" + N.ToString + "-Pos""/>" + vbCRLF
    A = A + "                </vertices>" + vbCRLF
    A = A + "                <triangles count=""" + T.Count.ToString + """ material=""PlayUpGrp0__1__playupnomaterial__physDefault"">" + vbCRLF
    A = A + "                    <input semantic=""VERTEX"" source=""#geometries_" + N.ToString + "-Vtx"" offset=""0""/>" + vbCRLF
    A = A + "                    <input semantic=""NORMAL"" source=""#geometries_" + N.ToString + "-Normal"" offset=""1""/>" + vbCRLF
    A = A + "                    <input semantic=""TEXCOORD"" source=""#geometries_" + N.ToString + "-Texture_Projection"" offset=""2""/>" + vbCRLF
    A = A + "                    <p>" + vbCRLF
    Dim triCounter As Integer = 0
    For Each tri As Rhino.Geometry.MeshFace In T
      'A = A + "                        " + tri.A.ToString + " " + tri.B.ToString + " " + tri.C.ToString + vbCRLF
      A = A + CreateTriString(tri.A, triCounter, 0)
      A = A + CreateTriString(tri.B, triCounter, 1)
      A = A + CreateTriString(tri.C, triCounter, 2)
      triCounter = triCounter + 1
    Next
    A = A + "                    </p>" + vbCRLF
    A = A + "                </triangles>" + vbCRLF
# ---------- create_geometries_n_triangles_element: VB additional code ----------
  Private Function CreateTriString (ByVal T As Integer, ByVal N As Integer, ByVal TexCoordIndex As Integer) As String
    Return "                        " + T.ToString + " " + N.ToString + " " + T.ToString + vbCRLF 'TexCoordIndex.ToString + vbCRLF
  End Function
# ---------- end create_geometries_n_triangles_element ----------
create_geometries_n_pos_element = CSharpScript(P=vbscript_decompose_mesh.V, N=series_from_list.N)  # -> out, A; inputs P: list of Point3d, N: Int32
# ---------- create_geometries_n_pos_element: C# ----------
    //define indents for ease of change later
    const string tab = "    ";
    const string indentString1 = tab + tab + tab + tab;
    const string indentString2 = indentString1 + tab;
    const string indentString3 = indentString2 + tab;
    const string indentString4 = indentString3 + tab;
    const string kind = @"Pos";
    const int stride = 3;

    //create string of positions
    A = @"";
    for(int i = 0; i < P.Count; i++){
      A = A + indentString3 + P[i].X + " " + P[i].Y + " " + P[i].Z + "\n";
    }

    //create the XML string
    A = indentString1 + "<source id=\"geometries_" + N.ToString() + "-" + kind + "\">\n" +
      indentString2 + "<float_array id=\"geometries_" + N.ToString() + "-" + kind + "-array\" count=\"" + (P.Count * stride).ToString() + "\">\n" +
      A +
      indentString2 + "</float_array>\n" +
      indentString2 + "<technique_common>\n" +
      indentString3 + "<accessor source=\"#geometries_" + N.ToString() + "-" + kind + "-array\" count=\"" + P.Count.ToString() + "\" stride=\"" + stride + "\">\n" +
      indentString4 + "<param name=\"X\" type=\"float\"/>\n" +
      indentString4 + "<param name=\"Y\" type=\"float\"/>\n" +
      indentString4 + "<param name=\"Z\" type=\"float\"/>\n" +
      indentString3 + "</accessor>\n" +
      indentString2 + "</technique_common>\n" +
      indentString1 + "</source>\n";
# ---------- end create_geometries_n_pos_element ----------
create_geometries_n_normal_element = CSharpScript(P=facen.Normals, N=series_from_list.N)  # -> out, A; inputs P: list of Point3d, N: Int32
# ---------- create_geometries_n_normal_element: C# ----------
    //define indents for ease of change later
    const string tab = "    ";
    const string indentString1 = tab + tab + tab + tab;
    const string indentString2 = indentString1 + tab;
    const string indentString3 = indentString2 + tab;
    const string indentString4 = indentString3 + tab;
    const string kind = @"Normal";
    const int stride = 3;

    //create string of positions
    A = @"";
    for(int i = 0; i < P.Count; i++){
      A = A + indentString3 +P[i].X + " " + P[i].Y + " " + P[i].Z + "\n";
    }

    //create the XML string
    A = indentString1 + "<source id=\"geometries_" + N.ToString() + "-" + kind + "\">\n" +
      indentString2 + "<float_array id=\"geometries_" + N.ToString() + "-" + kind + "-array\" count=\"" + (P.Count * stride).ToString() + "\">\n" +
      A +
      indentString2 + "</float_array>\n" +
      indentString2 + "<technique_common>\n" +
      indentString3 + "<accessor source=\"#geometries_" + N.ToString() + "-" + kind + "-array\" count=\"" + P.Count.ToString() + "\" stride=\"" + stride + "\">\n" +
      indentString4 + "<param name=\"X\" type=\"float\"/>\n" +
      indentString4 + "<param name=\"Y\" type=\"float\"/>\n" +
      indentString4 + "<param name=\"Z\" type=\"float\"/>\n" +
      indentString3 + "</accessor>\n" +
      indentString2 + "</technique_common>\n" +
      indentString1 + "</source>\n";
# ---------- end create_geometries_n_normal_element ----------
create_geometries_n_texture_projection_e = CSharpScript(P=join, N=series_from_list.N)  # -> out, A; "Create Geometries_N-Texture_Projection element"; inputs P: list of String, N: Int32
# ---------- create_geometries_n_texture_projection_e: C# ----------
    //define indents for ease of change later
    const string tab = "    ";
    const string indentString1 = tab + tab + tab + tab;
    const string indentString2 = indentString1 + tab;
    const string indentString3 = indentString2 + tab;
    const string indentString4 = indentString3 + tab;
    const string kind = @"Texture_Projection";
    const int stride = 2;

    //create string of positions
    A = @"";
    for(int i = 0; i < P.Count; i++){
      A = A + indentString3 + P[i] + "\n";//P[i].X + " " + P[i].Y + " " + P[i].Y + "\n";
    }

    //create the XML string
    A = indentString1 + "<source id=\"geometries_" + N.ToString() + "-" + kind + "\">\n" +
      indentString2 + "<float_array id=\"geometries_" + N.ToString() + "-" + kind + "-array\" count=\"" + (P.Count*2) + "\">\n" +
      // note the above line's count= used to be: P.Count
      A +
      indentString2 + "</float_array>\n" +
      indentString2 + "<technique_common>\n" +
      indentString3 + "<accessor source=\"#geometries_" + N.ToString() + "-" + kind + "-array\" count=\"" + P.Count + "\" stride=\"" + stride + "\">\n" +
      // note the above line's count= used to be: (P.Count / stride).ToString()
      indentString4 + "<param name=\"S\" type=\"float\"/>\n" +
      indentString4 + "<param name=\"T\" type=\"float\"/>\n" +
      indentString3 + "</accessor>\n" +
      indentString2 + "</technique_common>\n" +
      indentString1 + "</source>\n";
# ---------- end create_geometries_n_texture_projection_e ----------
join_the_strings_that_form_the_collada_x = Panel("")  # "Join the Strings that Form the Collada XML"
part_1 = Panel("""<?xml version="1.0" encoding="utf-8"?>
<COLLADA xmlns="http://www.collada.org/2005/11/COLLADASchema" version="1.4.1">""")
create_assets_element = CSharpScript()  # -> out, A
# ---------- create_assets_element: C# ----------
    //string Date = "";
    //string Time = "";
    A = "    <asset>\n" +
      "        <contributor>\n" +
      "            <authoring_tool>Stephen Davey Grasshopper Collada Exporter</authoring_tool>\n" +
      "        </contributor>\n" +
      "        <created>2011-09-06T18:06:31Z</created>\n" +
      "        <modified>2011-09-06T18:06:31Z</modified>\n" +
      "        <revision>1.4.1</revision>\n" +
      "        <unit meter=\"1.0\" name=\"meter\"></unit>\n" +
      "        <up_axis>Z_UP</up_axis>\n" +
      "    </asset>";
# ---------- end create_assets_element ----------
part_2 = Panel("""    <library_images>
        <image id="playupnomaterial_tif_img" format="bitmap" height="32" width="32" depth="32">
            <init_from>file:///C:/Users/nesis/Desktop/work stuff/russel 25-08 holidays/GH collada exporter/PlayupExports2/textures/playup_nomaterial.tif</init_from>
        </image>
    </library_images>
    <library_effects>
        <effect id="PlayUpGrp0-1-playupnomaterial_fx">                                
            <profile_COMMON>
                <newparam sid="playupnomaterial_tif_surface">
                    <surface type="2D">
                        <init_from>playupnomaterial_tif_img</init_from>
                    </surface>
                </newparam>
                <newparam sid="playupnomaterial_tif_sampler">
                    <sampler2D>
                        <source>playupnomaterial_tif_surface</source>
                    </sampler2D>
                </newparam>
                <technique sid="default">
                    <phong>
                        <emission>
                            <color sid="emission">0.000000 0.000000 0.000000 1.000000</color>
                        </emission>
                        <ambient>
                            <color sid="ambient">0.000000 0.000000 0.000000 1.000000</color>
                        </ambient>
                        <diffuse>
                            <color sid="diffuse">0.84 0.84 0.84 1.000000</color>
                        </diffuse>
                        <specular>
                            <color sid="specular">0.000000 0.000000 0.000000 1.000000</color>
                        </specular>
                        <shininess>
                            <float sid="shininess">0.000000</float>
                        </shininess>
                        <reflective>
                            <color sid="reflective">0.000000 0.000000 0.000000 1.000000</color>
                        </reflective>
                        <reflectivity>
                            <float sid="reflectivity">0.000000</float>
                        </reflectivity>
                        <transparent opaque="RGB_ZERO">
                            <color sid="transparent">0.000000 0.000000 0.000000 0.000000</color>
                        </transparent>
                        <transparency>
                            <float sid="transparency">0.000000</float>
                        </transparency>
                        <index_of_refraction>
                            <float sid="index_of_refraction">0.000000</float>
                        </index_of_refraction>
                    </phong>
                </technique>
            </profile_COMMON>
        </effect>

    </library_effects>
    <library_materials>
        <material id="PlayUpGrp0__1__playupnomaterial__physDefault">                                    
            <instance_effect url="#PlayUpGrp0-1-playupnomaterial_fx"></instance_effect>    
        </material>
    </library_materials>
    <library_geometries>""")
create_geometries_n_element = CSharpScript(
    Pos=create_geometries_n_pos_element.A,
    Norm=create_geometries_n_normal_element.A,
    Tex=create_geometries_n_texture_projection_e.A,
    Tri=create_geometries_n_triangles_element.A,
    N=series_from_list.N)  # -> out, flatten(A); inputs Pos: String, Norm: String, Tex: String, Tri: String, N: Int32
# ---------- create_geometries_n_element: C# ----------
    A = "        <geometry id=\"geometries_" + N.ToString() + "\">\n" +
      "            <mesh>\n" +
      Pos +
      Norm +
      Tex +
      Tri +
      "            </mesh>\n" +
      "        </geometry>\n";
# ---------- end create_geometries_n_element ----------
part_3 = Panel("""    </library_geometries>
    <library_visual_scenes>
        <visual_scene id="visual_scenes_0" name="untitled">
            <node id="CryExportNode_PlayUpGrp0">                                                                        
                    <translate sid="translation">0.000000 0.000000 0.000000</translate>
                    <rotate sid="rotateZ">0.000000 0.000000 1.000000 0.000000</rotate>
                    <rotate sid="rotateY">0.000000 1.000000 0.000000 0.000000</rotate>
                    <rotate sid="rotateX">1.000000 0.000000 0.000000 0.000000</rotate>
                    <scale sid="scale">1.000000 1.000000 1.000000</scale>
                            <node id="mesh0%root%0%">""")
create_instance_geometry_element = CSharpScript(N=series_from_list.N)  # -> out, flatten(A); inputs N: Int32
# ---------- create_instance_geometry_element: C# ----------
    A = "                                <instance_geometry url=\"#geometries_" + N.ToString() + "\">\n" +
      "                                    <bind_material>\n" +
      "                                        <technique_common>\n" +
      "                                            <instance_material symbol=\"PlayUpGrp0__1__playupnomaterial__physDefault\" target=\"#PlayUpGrp0__1__playupnomaterial__physDefault\">\n" +
      "                                                <bind semantic=\"diffuse_TEXCOORD\" target=\"geometries_" + N.ToString() + "-\"></bind>\n" +
      "                                            </instance_material>\n" +
      "                                        </technique_common>\n" +
      "                                    </bind_material>\n" +
      "                                </instance_geometry>\n";
# ---------- end create_instance_geometry_element ----------
part_4 = Panel("""                </node>
            </node>
        </visual_scene>
    </library_visual_scenes>
    <scene>
        <instance_visual_scene url="#visual_scenes_0"/>
    </scene>
</COLLADA>""")
join_2 = StringJoin(Strings=create_instance_geometry_element.A)
join_3 = StringJoin(Strings=create_geometries_n_element.A)
newline = Panel("")
join_4 = StringJoin(Strings=[part_1, create_assets_element.A, part_2, join_3, part_3, join_2, part_4], Join=newline)
get_current_gh_file_path = VBScript()  # -> out, Path
# ---------- get_current_gh_file_path: VB ----------
    'A = Grasshopper.GH_InstanceServer.DocumentServer.Contains(

    Dim k As GH_Document = Grasshopper.GH_InstanceServer.DocumentServer(0)
    Path = k.FilePath.Substring(0, k.FilePath.LastIndexOf("\"))
# ---------- end get_current_gh_file_path ----------
# Save DAE File: This should save a DAE named the same as the text in the "Filename" panel. It saves to the same directory this Grasshopper script is located.
filename_2 = String(filename)
dae_xml_string_data = String(join_4)
write_dae = CSharpScript(Filename=filename_2, Filepath=get_current_gh_file_path.Path, XML=dae_xml_string_data)  # -> out, A; inputs Filename: String, Filepath: String, XML: String
# ---------- write_dae: C# ----------
    string filepath = @Filepath + @"\" + @Filename + @".dae";
    //filepath.Replace(@" ", @"\u0020");
    System.IO.File.WriteAllText(filepath, XML);
    A = filepath;
# ---------- end write_dae ----------
where_file_was_written_to = Panel(write_dae.A)
