# Grasshopper definition GH collada exporter 6.gh (Grasshopper 0.8.51)

box = CenterBox(Base=PlaneXY(0, 0, 0), X=1, Y=1, Z=1)
# COLLADA EXPORTER THATCHED TOGETHER FROM A GENERIC (GROUPED) BOX EXPORTED AS .DAE FROM SKETCHUP 7.
brep = Brep(box)
mesh = MeshBrep(
    Brep=brep,
    Settings={Refine=True, JaggedSeams=False, SimplePlanes=True, GridMinCount=16, GridMaxCount=0, Tolerance=0, RefineAngle=0, MinTolerance=0, RelativeTolerance=0.65, MinEdgeLength=0.0001, MaxEdgeLength=0})
lng = ListLength(List=mesh)
tri = Triangulate(Mesh=flatten(mesh))  # -> Mesh, Count
series = Series(Start=0, Step=1, Count=lng)  # -> graft(Series)
decompose_mesh = VBScript(M=tri.Mesh)  # -> out, V, F, N; inputs M: Mesh
# ---------- decompose_mesh: C# ----------
    V = M.Vertices
    F = M.Faces
    N = M.Normals
# ---------- end decompose_mesh ----------
simplify = SimplifyTree(Tree=series, Front=False)
create_triangles_xml = Panel(" ")
point_to_string = VBScript(P=decompose_mesh.V)  # -> out, S; inputs P: Point3d
# ---------- point_to_string: C# ----------
    S = P.X.ToString + " " + P.Y.ToString + " " + P.Z.ToString
# ---------- end point_to_string ----------
lng_2 = ListLength(List=decompose_mesh.V)
get_face_vertex_indexes = VBScript(F=decompose_mesh.F)  # -> out, A, B, C, S
# ---------- get_face_vertex_indexes: VB ----------
    'Dim F As Rhino.Geometry.MeshFace
    A = F.A
    B = F.B
    C = F.C
    S = F.A.ToString + " " + F.B.ToString + " " + F.C.ToString
# ---------- end get_face_vertex_indexes ----------
point_to_string_2 = VBScript(P=decompose_mesh.N)  # -> out, S; inputs P: Point3d; same code as point_to_string
lng_3 = ListLength(List=decompose_mesh.F)
join = StringJoin(Strings=get_face_vertex_indexes.S, Join=" ")
multiplication = Multiplication(A=lng_2, B=3)
join_2 = StringJoin(Strings=point_to_string.S, Join=" ")
join_3 = StringJoin(Strings=point_to_string_2.S, Join=" ")
create_geometry_xml = VBScript(N=simplify, VCC=multiplication, VC=lng_2, TC=lng_3, VS=join_2, NS=join_3, TS=join)  # -> out, A
# ---------- create_geometry_xml: C# ----------
    N = N * 5
    A = "        <geometry id=""ID" + N.ToString + """>" + vbCRLF
    A = A + "            <mesh>" + vbCRLF
    A = A + "                <source id=""VERTS" + N.ToString + """>" + vbCRLF
    A = A + "                    <float_array id=""VERTCOMPS" + N.ToString + """ count=""" + VCC.ToString + """>" + VS + "</float_array>" + vbCRLF
    A = A + "                    <technique_common>" + vbCRLF
    A = A + "                        <accessor count=""" + VC.ToString + """ source=""#VERTCOMPS" + N.ToString + """ stride=""3"">" + vbCRLF
    A = A + "                            <param name=""X"" type=""float"" />" + vbCRLF
    A = A + "                            <param name=""Y"" type=""float"" />" + vbCRLF
    A = A + "                            <param name=""Z"" type=""float"" />" + vbCRLF
    A = A + "                        </accessor>" + vbCRLF
    A = A + "                    </technique_common>" + vbCRLF
    A = A + "                </source>" + vbCRLF
    A = A + "                <source id=""NORMS" + N.ToString + """>" + vbCRLF
    A = A + "                    <float_array id=""NORMCOMPS" + N.ToString + """ count=""" + VCC.ToString + """>" + NS + "</float_array>" + vbCRLF
    A = A + "                    <technique_common>" + vbCRLF
    A = A + "                        <accessor count=""" + VC.ToString + """ source=""#NORMCOMPS" + N.ToString + """ stride=""3"">" + vbCRLF
    A = A + "                            <param name=""X"" type=""float"" />" + vbCRLF
    A = A + "                            <param name=""Y"" type=""float"" />" + vbCRLF
    A = A + "                            <param name=""Z"" type=""float"" />" + vbCRLF
    A = A + "                        </accessor>" + vbCRLF
    A = A + "                    </technique_common>" + vbCRLF
    A = A + "                </source>" + vbCRLF
    A = A + "                <vertices id=""TRIS" + N.ToString + """>" + vbCRLF
    A = A + "                    <input semantic=""POSITION"" source=""#VERTS" + N.ToString + """ />" + vbCRLF
    A = A + "                    <input semantic=""NORMAL"" source=""#NORMS" + N.ToString + """ />" + vbCRLF
    A = A + "                </vertices>" + vbCRLF
    A = A + "                <triangles count=""" + TC.ToString + """ material=""Material2"">" + vbCRLF
    A = A + "                    <input offset=""0"" semantic=""VERTEX"" source=""#TRIS" + N.ToString + """ />" + vbCRLF
    A = A + "                    <p>" + TS + "</p>" + vbCRLF
    A = A + "                </triangles>" + vbCRLF
    A = A + "            </mesh>" + vbCRLF
    A = A + "        </geometry>"
# ---------- end create_geometry_xml ----------
create_instance_geometry_xml = VBScript(N=simplify)  # -> out, A
# ---------- create_instance_geometry_xml: C# ----------
    N = N * 5
    A = "                    <instance_geometry url=""#ID" + N.ToString + """>" + vbCRLF
    A = A + "                        <bind_material>" + vbCRLF
    A = A + "                            <technique_common>" + vbCRLF
    A = A + "                                <instance_material symbol=""Material2"" target=""#ONEMATERIAL"">" + vbCRLF
    A = A + "                                    <bind_vertex_input semantic=""UVSET0"" input_semantic=""TEXCOORD"" input_set=""0"" />" + vbCRLF
    A = A + "                                </instance_material>" + vbCRLF
    A = A + "                            </technique_common>" + vbCRLF
    A = A + "                        </bind_material>" + vbCRLF
    A = A + "                    </instance_geometry>"
# ---------- end create_instance_geometry_xml ----------
panel = Panel("""<?xml version="1.0" encoding="UTF-8" standalone="no" ?>
<COLLADA xmlns="http://www.collada.org/2005/11/COLLADASchema" version="1.4.1">
    <asset>
        <contributor>
            <authoring_tool>Google SketchUp 7.1.6087</authoring_tool>
        </contributor>
        <created>2011-09-01T15:24:19Z</created>
        <modified>2011-09-01T15:24:19Z</modified>
        <unit meter="0.0254" name="inch" />
        <up_axis>Z_UP</up_axis>
    </asset>
    <library_visual_scenes>
        <visual_scene id="ONEVISUALSCENE">
            <node name="SketchUp">
                <node id="ONEGROUP" name="group_0">""")
panel_2 = Panel(create_instance_geometry_xml.A)
panel_3 = Panel("""                </node>
            </node>
        </visual_scene>
    </library_visual_scenes>
    <library_geometries>""")
panel_4 = Panel(create_geometry_xml.A)
panel_5 = Panel("""    </library_geometries>
    <library_materials>
        <material id="ONEMATERIAL" name="material_0">
            <instance_effect url="#ONEEFFECT" />
        </material>
    </library_materials>
    <library_effects>
        <effect id="ONEEFFECT">
            <profile_COMMON>
                <technique sid="COMMON">
                    <lambert>
                        <diffuse>
                            <color>0.8901961 0.8823529 0.8705882 1</color>
                        </diffuse>
                    </lambert>
                </technique>
            </profile_COMMON>
        </effect>
    </library_effects>
    <scene>
        <instance_visual_scene url="#ONEVISUALSCENE" />
    </scene>
</COLLADA>""")
newline = Panel("")
join_4 = StringJoin(Strings=flatten(panel_4), Join=newline)
join_5 = StringJoin(Strings=flatten(panel_2), Join=newline)
concatenate_all_xml_parts = VBScript(S2=panel, S3=join_5, S4=panel_3, S5=join_4, S6=panel_5)  # -> out, A
# ---------- concatenate_all_xml_parts: C# ----------
    A = S1 + VbCrLf + S2 + VbCrLf + S3 + VbCrLf + S4 + VbCrLf + S5 + VbCrLf + S6
# ---------- end concatenate_all_xml_parts ----------
# INSTRUCTIONS: Right click this and change where it streams to to save a new DAE file. You'll probably want to enter your own filename (eg, myExport.dae).
output = Panel(concatenate_all_xml_parts.A)
