# Grasshopper definition GH collada exporter 7.gh (Grasshopper 0.8.51)

slider = Slider(0.5, range=0..1)
series = Series(Start=0, Step=expr("N*2", slider), Count=Slider(5, range=0..5))
pt = PointXYZ(XComponent=0, YComponent=0, ZComponent=slider)
box = CenterBox(Base=pt, X=slider, Y=slider, Z=slider)
Z = UnitZ(Factor=series)
move = Move(Geometry=box, Translation=Z)  # -> Geometry, Transform
# COLLADA EXPORTER THATCHED TOGETHER FROM A GENERIC (GROUPED) BOX EXPORTED AS .DAE FROM SKETCHUP 7.
brep = Brep(move.Geometry)
mesh = MeshBrep(
    Brep=brep,
    Settings={Refine=True, JaggedSeams=False, SimplePlanes=True, GridMinCount=16, GridMaxCount=0, Tolerance=0, RefineAngle=0, MinTolerance=0, RelativeTolerance=0.65, MinEdgeLength=0.0001, MaxEdgeLength=0})
lng = ListLength(List=mesh)
tri = Triangulate(Mesh=flatten(mesh))  # -> Mesh, Count
series_2 = Series(Start=0, Step=1, Count=lng)  # -> graft(Series)
decompose_mesh = VBScript(M=tri.Mesh)  # -> out, V, F, N; inputs M: Mesh
# ---------- decompose_mesh: C# ----------
    V = M.Vertices
    F = M.Faces
    N = M.Normals
# ---------- end decompose_mesh ----------
simplify = SimplifyTree(Tree=series_2, Front=False)
create_triangles_xml = Panel(" ")
point_to_string = VBScript(P=decompose_mesh.V)  # -> out, S; inputs P: Point3d
# ---------- point_to_string: C# ----------
    S = P.X.ToString + " " + P.Y.ToString + " " + P.Z.ToString
# ---------- end point_to_string ----------
lng_2 = ListLength(List=decompose_mesh.V)
get_face_vertex_indexes = VBScript(F=decompose_mesh.F)  # -> out, A, B, C, S
# ---------- get_face_vertex_indexes: VB ----------
    'Dim F As Rhino.Geometry.MeshFace
    A = F.A
    B = F.B
    C = F.C
    S = F.A.ToString + " " + F.B.ToString + " " + F.C.ToString
# ---------- end get_face_vertex_indexes ----------
point_to_string_2 = VBScript(P=decompose_mesh.N)  # -> out, S; inputs P: Point3d; same code as point_to_string
lng_3 = ListLength(List=decompose_mesh.F)
join = StringJoin(Strings=get_face_vertex_indexes.S, Join=" ")
multiplication = Multiplication(A=lng_2, B=3)
join_2 = StringJoin(Strings=point_to_string.S, Join=" ")
join_3 = StringJoin(Strings=point_to_string_2.S, Join=" ")
create_geometry_xml = VBScript(N=simplify, VCC=multiplication, VC=lng_2, TC=lng_3, VS=join_2, NS=join_3, TS=join)  # -> out, A
# ---------- create_geometry_xml: C# ----------
    A = "        <geometry id=""ID" + N.ToString + """>" + vbCRLF
    A = A + "            <mesh>" + vbCRLF
    A = A + "                <source id=""VERTS" + N.ToString + """>" + vbCRLF
    A = A + "                    <float_array id=""VERTCOMPS" + N.ToString + """ count=""72"">10 20 10 0 30 10 0 20 10 10 30 10 0 30 10 0 20 0 0 20 10 0 30 0 10 20 10 0 20 0 10 20 0 0 20 10 10 30 0 10 20 10 10 20 0 10 30 10 0 30 10 10 30 0 0 30 0 10 30 10 10 30 0 0 20 0 0 30 0 10 20 0</float_array>" + vbCRLF
    A = A + "                    <technique_common>" + vbCRLF
    A = A + "                        <accessor count=""24"" source=""#VERTCOMPS" + N.ToString + """ stride=""3"">" + vbCRLF
    A = A + "                            <param name=""X"" type=""float"" />" + vbCRLF
    A = A + "                            <param name=""Y"" type=""float"" />" + vbCRLF
    A = A + "                            <param name=""Z"" type=""float"" />" + vbCRLF
    A = A + "                        </accessor>" + vbCRLF
    A = A + "                    </technique_common>" + vbCRLF
    A = A + "                </source>" + vbCRLF
    A = A + "                <source id=""NORMS" + N.ToString + """>" + vbCRLF
    A = A + "                    <float_array id=""NORMCOMPS" + N.ToString + """ count=""72"">0 0 1 0 0 1 0 0 1 0 0 1 -1 0 0 -1 0 0 -1 0 0 -1 0 0 -0 -1 -0 -0 -1 -0 -0 -1 -0 -0 -1 -0 1 0 0 1 0 0 1 0 0 1 0 0 0 1 0 0 1 0 0 1 0 0 1 0 0 0 -1 0 0 -1 0 0 -1 0 0 -1</float_array>" + vbCRLF
    A = A + "                    <technique_common>" + vbCRLF
    A = A + "                        <accessor count=""24"" source=""#NORMCOMPS" + N.ToString + """ stride=""3"">" + vbCRLF
    A = A + "                            <param name=""X"" type=""float"" />" + vbCRLF
    A = A + "                            <param name=""Y"" type=""float"" />" + vbCRLF
    A = A + "                            <param name=""Z"" type=""float"" />" + vbCRLF
    A = A + "                        </accessor>" + vbCRLF
    A = A + "                    </technique_common>" + vbCRLF
    A = A + "                </source>" + vbCRLF
    A = A + "                <vertices id=""TRIS" + N.ToString + """>" + vbCRLF
    A = A + "                    <input semantic=""POSITION"" source=""#VERTS" + N.ToString + """ />" + vbCRLF
    A = A + "                    <input semantic=""NORMAL"" source=""#NORMS" + N.ToString + """ />" + vbCRLF
    A = A + "                </vertices>" + vbCRLF
    A = A + "                <triangles count=""12"" material=""Material2"">" + vbCRLF
    A = A + "                    <input offset=""0"" semantic=""VERTEX"" source=""#TRIS" + N.ToString + """ />" + vbCRLF
    A = A + "                    <p>0 1 2 1 0 3 4 5 6 5 4 7 8 9 10 9 8 11 12 13 14 13 12 15 16 17 18 17 16 19 20 21 22 21 20 23</p>" + vbCRLF
    A = A + "                </triangles>" + vbCRLF
    A = A + "            </mesh>" + vbCRLF
    A = A + "        </geometry>"
# ---------- end create_geometry_xml ----------
create_instance_geometry_xml = VBScript(N=simplify)  # -> out, A
# ---------- create_instance_geometry_xml: C# ----------
    A = "                    <instance_geometry url=""#ID" + N.ToString + """>" + vbCRLF
    A = A + "                        <bind_material>" + vbCRLF
    A = A + "                            <technique_common>" + vbCRLF
    A = A + "                                <instance_material symbol=""Material2"" target=""#ONEMATERIAL"">" + vbCRLF
    A = A + "                                    <bind_vertex_input semantic=""UVSET0"" input_semantic=""TEXCOORD"" input_set=""0"" />" + vbCRLF
    A = A + "                                </instance_material>" + vbCRLF
    A = A + "                            </technique_common>" + vbCRLF
    A = A + "                        </bind_material>" + vbCRLF
    A = A + "                    </instance_geometry>"
# ---------- end create_instance_geometry_xml ----------
panel = Panel("""<?xml version="1.0" encoding="UTF-8" standalone="no" ?>
<COLLADA xmlns="http://www.collada.org/2005/11/COLLADASchema" version="1.4.1">
    <asset>
        <contributor>
            <authoring_tool>Google SketchUp 7.1.6087</authoring_tool>
        </contributor>
        <created>2011-09-01T15:24:19Z</created>
        <modified>2011-09-01T15:24:19Z</modified>
        <unit meter="0.0254" name="inch" />
        <up_axis>Z_UP</up_axis>
    </asset>
    <library_visual_scenes>
        <visual_scene id="ONEVISUALSCENE">
            <node name="SketchUp">
                <node id="ID2" name="group_0">
                    <matrix>1 0 0 0 0 1 0 0 0 0 1 0 0 0 0 1</matrix>""")
panel_2 = Panel(create_instance_geometry_xml.A)
panel_3 = Panel("""                </node>
            </node>
        </visual_scene>
    </library_visual_scenes>
    <library_geometries>""")
panel_4 = Panel(create_geometry_xml.A)
panel_5 = Panel("""    </library_geometries>
    <library_materials>
        <material id="ONEMATERIAL" name="material_0">
            <instance_effect url="#ONEEFFECT" />
        </material>
    </library_materials>
    <library_effects>
        <effect id="ONEEFFECT">
            <profile_COMMON>
                <technique sid="COMMON">
                    <lambert>
                        <diffuse>
                            <color>0.8901961 0.8823529 0.8705882 1</color>
                        </diffuse>
                    </lambert>
                </technique>
            </profile_COMMON>
        </effect>
    </library_effects>
    <scene>
        <instance_visual_scene url="#ONEVISUALSCENE" />
    </scene>
</COLLADA>""")
newline = Panel("")
join_4 = StringJoin(Strings=flatten(panel_4), Join=newline)
join_5 = StringJoin(Strings=flatten(panel_2), Join=newline)
concatenate_all_xml_parts = VBScript(S1=panel, S2=join_5, S3=panel_3, S4=join_4, S5=panel_5)  # -> out, A
# ---------- concatenate_all_xml_parts: C# ----------
    A = S1 + VbCrLf + S2 + VbCrLf + S3 + VbCrLf + S4 + VbCrLf + S5
# ---------- end concatenate_all_xml_parts ----------
# INSTRUCTIONS: Right click this and change where it streams to to save a new DAE file. You'll probably want to enter your own filename (eg, myExport.dae).
output = Panel(concatenate_all_xml_parts.A)
